# Grasshopper definition Drawer.gh (Grasshopper 0.9.76)

thickness = Slider(0.03, range=0.001..0.03)
width = Slider(1.018, range=0.1..2)
height = Slider(0.219, range=0.02..0.3)
depth = Slider(0.951, range=0.2..1.5)
drawer_separation = Slider(0.02, range=0.002..0.02)
numdrawers = Slider(5, range=1..10)
open = Slider(0.491, range=0..1)
opendrawer = Slider(2, range=0..10)

# ---- group: Open Position
multiplication = Multiplication(A=open, B=depth)
neg = Negative(Value=multiplication)

# ---- group: Width - 2*Thickness
multiplication_2 = Multiplication(A=2, B=thickness)
subtraction = Subtraction(A=width, B=multiplication_2)

# ---- group: Width - 3*Thickness
multiplication_3 = Multiplication(A=3, B=thickness)
subtraction_2 = Subtraction(A=width, B=multiplication_3)

# ---- group: Depth + Thickness
addition = Addition(A=depth, B=thickness)

# ---- group: True Height
addition_2 = Addition(A=height, B=drawer_separation)

# ---- group: Total Height
multiplication_4 = Multiplication(A=addition_2, B=numdrawers)

# ---- group: Width - Thickness
subtraction_3 = Subtraction(A=width, B=thickness)

# ---- group: Height - Thickness
subtraction_4 = Subtraction(A=height, B=thickness)

# ---- group: - Thickness
neg_2 = Negative(Value=thickness)

# ---- group: Multi-Drawer
subtraction_5 = Subtraction(A=numdrawers, B=1)
series = Series(Start=0, Step=0, Count=numdrawers)
min = Minimum(A=opendrawer, B=subtraction_5)
series_2 = Series(Start=0, Step=1, Count=numdrawers)
replace = ReplaceItems(List=series, Item=neg, Indices=min, Wrap=False)
multiplication_5 = Multiplication(A=series_2, B=addition_2)

# ----
dom = ConstructDomain(DomainStart=neg_2, DomainEnd=subtraction_3)
pt = ConstructPoint(XCoordinate=0, YCoordinate=0, ZCoordinate=[multiplication_4, neg_2])
dom_2 = ConstructDomain(DomainStart=neg_2, DomainEnd=addition)
pt_2 = ConstructPoint(XCoordinate=subtraction, YCoordinate=0, ZCoordinate=0)
pt_3 = ConstructPoint(XCoordinate=neg_2, YCoordinate=0, ZCoordinate=0)
pt_4 = ConstructPoint(XCoordinate=0, YCoordinate=addition, ZCoordinate=0)
pt_5 = ConstructPoint(XCoordinate=subtraction_2, YCoordinate=0, ZCoordinate=0)
pt_6 = ConstructPoint(XCoordinate=0, YCoordinate=depth, ZCoordinate=0)
dom_3 = ConstructDomain(DomainStart=thickness, DomainEnd=subtraction_4)
dom_4 = ConstructDomain(DomainStart=thickness, DomainEnd=subtraction_2)
xy = XYPlane(Origin=Point(0, 0, 0))
yz = YZPlane(Origin=Point(0, 0, 0))
yz_2 = YZPlane(Origin=pt_5)
xz = XZPlane(Origin=pt_6)
xz_2 = XZPlane(Origin=Point(0, 0, 0))
xy_2 = XYPlane(Origin=pt)
yz_3 = YZPlane(Origin=pt_2)
yz_4 = YZPlane(Origin=pt_3)
xz_3 = XZPlane(Origin=pt_4)
rectangle = Rectangle(Plane=xy_2, XSize=dom, YSize=dom_2, Radius=0)  # -> Rectangle, Length
rectangle_2 = Rectangle(Plane=[yz_4, yz_3], XSize=addition, YSize=multiplication_4, Radius=0)  # -> Rectangle, Length
rectangle_3 = Rectangle(Plane=xz_3, XSize=subtraction, YSize=multiplication_4, Radius=0)  # -> Rectangle, Length
rectangle_4 = Rectangle(Plane=xy, XSize=subtraction, YSize=depth, Radius=0)  # -> Rectangle, Length
rectangle_5 = Rectangle(Plane=[yz_2, yz], XSize=depth, YSize=dom_3, Radius=0)  # -> Rectangle, Length
rectangle_6 = Rectangle(Plane=xz, XSize=dom_4, YSize=dom_3, Radius=0)  # -> Rectangle, Length
rectangle_7 = Rectangle(Plane=xz_2, XSize=dom, YSize=height, Radius=0)  # -> Rectangle, Length
boxrec = BoxRectangle(Rectangle=rectangle_4.Rectangle, Height=thickness)
boxrec_2 = BoxRectangle(Rectangle=rectangle_5.Rectangle, Height=thickness)
boxrec_3 = BoxRectangle(Rectangle=rectangle_6.Rectangle, Height=thickness)
boxrec_4 = BoxRectangle(Rectangle=rectangle_7.Rectangle, Height=thickness)
boxrec_5 = BoxRectangle(Rectangle=rectangle.Rectangle, Height=thickness)
boxrec_6 = BoxRectangle(Rectangle=rectangle_3.Rectangle, Height=thickness)
boxrec_7 = BoxRectangle(Rectangle=rectangle_2.Rectangle, Height=thickness)
vec = VectorXYZ(XComponent=0, YComponent=replace, ZComponent=multiplication_5)  # -> Vector, Length
drawer = Group(Objects=[boxrec, boxrec_2, boxrec_3, boxrec_4])
frame = Geometry([boxrec_5, boxrec_7, boxrec_6])
move = Move(Geometry=drawer, Motion=vec.Vector)  # -> Geometry, Transform
drawers = Geometry(move.Geometry)
