# Grasshopper definition BasicTable.gh (Grasshopper 0.9.76)

# ----
# Legs
top_leg_width_factor = Slider(1.6, range=1..3)
leg_width = Slider(0.03, range=0.03..0.5)

# ----
# Table
height = Slider(0.75, range=-0.01..1.5)
thickness = Slider(0.06, range=-0.01..0.2)
# TABLE
width = Slider(1.359, range=0..2)
depth = Slider(0.823, range=0..2)

P = Plane(PlaneXY(0, 0, 0))
subtraction = Subtraction(A=height, B=thickness)
subtraction_2 = Subtraction(A=width, B=leg_width)
subtraction_3 = Subtraction(A=depth, B=leg_width)
rectangle = Rectangle(Plane=P, XSize=subtraction_2, YSize=subtraction_3, Radius=0)  # -> Rectangle, Length
Z = UnitZ(Factor=subtraction)
Z_2 = UnitZ(Factor=thickness)
explode = BrepComponents(Brep=rectangle.Rectangle)  # -> Faces, Edges, Vertices
rectangle_2 = Rectangle(Plane=P, XSize=width, YSize=depth, Radius=0)  # -> Rectangle, Length
rectangle_3 = Rectangle(Plane=explode.Vertices, XSize=leg_width, YSize=leg_width, Radius=0)  # -> Rectangle, Length
explode_2 = BrepComponents(Brep=rectangle_2.Rectangle)  # -> Faces, Edges, Vertices
planar = PlanarSrf(Edges=rectangle_2.Rectangle)
scale = Scale(Geometry=rectangle_3.Rectangle, Center=explode_2.Vertices, Factor=top_leg_width_factor)  # -> Geometry, Transform
move = Move(Geometry=planar, Motion=Z)  # -> Geometry, Transform
move_2 = Move(Geometry=scale.Geometry, Motion=Z)  # -> Geometry, Transform
graft = GraftTree(Data=move_2.Geometry, IncludeEmptyLists=True, IncludeNullItems=True)
graft_2 = GraftTree(Data=rectangle_3.Rectangle, IncludeEmptyLists=True, IncludeNullItems=True)
extr = Extrude(Base=move.Geometry, Direction=Z_2)
loft = Loft(
    Curves=[graft, graft_2],
    Options={Adjust=False, Closed=False, LoftEnds=0, LoftSimp=0, LoftType=0, Rebuild=10, Refit=0.01})
cap = CapHoles(Brep=loft)
cap_2 = CapHoles(Brep=extr)
table_board = Geometry(cap_2)
legs = Geometry(cap)
