# Grasshopper definition Bathtub.gh (Grasshopper 0.9.76)

length = Slider(1.532, range=0.5..2.5)
width = Slider(0.781, range=0.5..2.5)
height = Slider(0.522, range=0.1..1)
padding = Slider(0.102, range=0.01..0.2)
tubheight = Slider(0.764, range=0..1)
roundness = Slider(0.455, range=0..1)
height_2 = Number(height)
padding_2 = Number(padding)
roundness_2 = Number(roundness)
length_2 = Number(length)
totalwidth = Number(width)
tubheight_2 = Number(tubheight)
multiplication = Multiplication(A=padding_2, B=2)
multiplication_2 = Multiplication(A=height_2, B=0.6)
neg = Negative(Value=height_2)
multiplication_3 = Multiplication(A=height_2, B=0.3)
vec = VectorXYZ(XComponent=0, YComponent=0, ZComponent=height_2)  # -> Vector, Length
vec_2 = VectorXYZ(XComponent=padding_2, YComponent=padding_2, ZComponent=height_2)  # -> Vector, Length
subtraction = Subtraction(A=length_2, B=multiplication)
subtraction_2 = Subtraction(A=totalwidth, B=multiplication)
division = Division(A=subtraction_2, B=2)
multiplication_4 = Multiplication(A=multiplication_2, B=tubheight_2)
pl_origin = PlaneOrigin(Base=PlaneXY(0, 0, 0), Origin=vec.Vector)
pl_origin_2 = PlaneOrigin(Base=PlaneXY(0, 0, 0), Origin=vec_2.Vector)
multiplication_5 = Multiplication(A=division, B=roundness_2)
addition = Addition(A=multiplication_3, B=multiplication_4)
rectangle = Rectangle(Plane=pl_origin, XSize=length_2, YSize=totalwidth, Radius=0)  # -> Rectangle, Length
rectangle_2 = Rectangle(Plane=pl_origin_2, XSize=subtraction, YSize=subtraction_2, Radius=multiplication_5)  # -> Rectangle, Length
vec_3 = VectorXYZ(XComponent=0, YComponent=0, ZComponent=neg)  # -> Vector, Length
neg_2 = Negative(Value=addition)
move = Move(Geometry=rectangle.Rectangle, Motion=vec_3.Vector)  # -> Geometry, Transform
vec_4 = VectorXYZ(XComponent=0, YComponent=0, ZComponent=neg_2)  # -> Vector, Length
move_2 = Move(Geometry=rectangle_2.Rectangle, Motion=vec_4.Vector)  # -> Geometry, Transform
boundary = BoundarySurfaces(Edges=[rectangle.Rectangle, rectangle_2.Rectangle])
boundary_2 = BoundarySurfaces(Edges=move_2.Geometry)
extr = Extrude(Base=rectangle.Rectangle, Direction=vec_3.Vector)
boundary_3 = BoundarySurfaces(Edges=move.Geometry)
extr_2 = Extrude(Base=rectangle_2.Rectangle, Direction=vec_4.Vector)
join = BrepJoin(Breps=[boundary, boundary_2, extr, boundary_3, extr_2])  # -> Breps, Closed
bathtub = Geometry(join.Breps)
