# Grasshopper definition Bookshelf.gh (Grasshopper 0.9.76)

top_board_thickness = Slider(0.061, range=0.01..0.5)
base_height = Slider(0.05, range=0.01..1)

leaves_thickness = Slider(0.013, range=0.001..0.1)
leaves_frame_width = Slider(0.025, range=0..0.1)
nº_leaves = Slider(3, range=1..8)

shelve_thickness = Slider(0.017, range=0.001..0.1)
nº_shelves = Slider(4, range=0..10)

body_thickness = Slider(0.05, range=0.01..1)
depth = Slider(0.294, range=0..1)
height = Slider(1.696, range=0..5)
width = Slider(1.153, range=0.05..5)

subtraction = Subtraction(A=height, B=top_board_thickness)
xz = XZPlane(Origin=Point(0, 0, 0))
subtraction_2 = Subtraction(A=subtraction, B=base_height)
Z = UnitZ(Factor=base_height)
rectangle = Rectangle(Plane=xz, XSize=width, YSize=subtraction_2, Radius=0)  # -> Rectangle, Length
neg = Negative(Value=body_thickness)
P = Plane(PlaneXY(0, 0, 0))
move = Move(Geometry=rectangle.Rectangle, Motion=Z)  # -> Geometry, Transform
rectangle_2 = Rectangle(Plane=P, XSize=width, YSize=depth, Radius=0)  # -> Rectangle, Length
Z_2 = UnitZ(Factor=subtraction)
offset = Offset(Curve=move.Geometry, Distance=neg, Plane=PlaneXY(0, 0, 0), Corners=1)
subtraction_3 = Subtraction(A=depth, B=leaves_thickness)
Y = UnitY(Factor=body_thickness)
move_2 = Move(Geometry=rectangle_2.Rectangle, Motion=Z_2)  # -> Geometry, Transform
multiplication = Multiplication(A=body_thickness, B=2)
explode = Explode(Curve=offset, Recursive=True)  # -> Segments, Vertices
Y_2 = UnitY(Factor=subtraction_3)
P_2 = Plane(PlaneXY(0, 0, 0))
item = ListItem(List=explode.Segments, Index=3, Wrap=True)
rectangle_3 = Rectangle(Plane=P_2, XSize=width, YSize=subtraction_3, Radius=0)  # -> Rectangle, Length
addition = Addition(A=nº_shelves, B=1)
subtraction_4 = Subtraction(A=subtraction_3, B=body_thickness)
subtraction_5 = Subtraction(A=width, B=multiplication)
division = Division(A=shelve_thickness, B=2)
division_2 = Division(A=width, B=nº_leaves)
pt = ConstructPoint(XCoordinate=0, YCoordinate=Y_2, ZCoordinate=base_height)
boxrec = BoxRectangle(Rectangle=move_2.Geometry, Height=top_board_thickness)
cluster = Cluster(C=rectangle_3.Rectangle, x=body_thickness)  # -> L, L_2, pl, C_2
divide = DivideCurve(Curve=item, Count=addition, Kinks=False)  # -> Points, Tangents, Parameters
boxrec_2 = BoxRectangle(Rectangle=rectangle_3.Rectangle, Height=base_height)
xz_2 = XZPlane(Origin=pt)
lng = ListLength(List=divide.Points)
join = JoinCurves(Curves=[cluster.L, cluster.L_2, cluster.pl, cluster.C_2], Preserve=False)
Z_3 = UnitZ(Factor=base_height)
Z_4 = UnitZ(Factor=subtraction_2)
subtraction_6 = Subtraction(A=lng, B=1)
cull_i = CullIndex(List=divide.Points, Indices=subtraction_6, Wrap=True)
recgrid = Rectangular(Plane=xz_2, SizeX=division_2, SizeY=subtraction_2, ExtentX=nº_leaves, ExtentY=1)  # -> Cells, Points
neg_2 = Negative(Value=leaves_frame_width)
Y_3 = UnitY(Factor=subtraction_4)
Z_5 = UnitZ(Factor=division)
P_3 = Plane(PlaneXY(0, 0, 0))
move_3 = Move(Geometry=join, Motion=Z_3)  # -> Geometry, Transform
division_3 = Division(A=leaves_thickness, B=2)
cull_i_2 = CullIndex(List=cull_i, Indices=0, Wrap=True)
neg_3 = Negative(Value=Z_5)
boundary = BoundarySurfaces(Edges=move_3.Geometry)
Y_4 = UnitY(Factor=division_3)
offset_2 = Offset(Curve=recgrid.Cells, Distance=neg_2, Plane=P_3, Corners=1)
move_4 = Move(Geometry=cull_i_2, Motion=Y)  # -> Geometry, Transform
move_5 = Move(Geometry=move_4.Geometry, Motion=neg_3)  # -> Geometry, Transform
crv = Curve(flatten([recgrid.Cells, offset_2]))
extr = Extrude(Base=boundary, Direction=Z_4)
Y_5 = UnitY(Factor=leaves_thickness)
boundary_2 = BoundarySurfaces(Edges=crv)
move_6 = Move(Geometry=offset_2, Motion=Y_4)  # -> Geometry, Transform
xz_3 = XZPlane(Origin=move_5.Geometry)
rectangle_4 = Rectangle(Plane=xz_3, XSize=subtraction_5, YSize=shelve_thickness, Radius=0)  # -> Rectangle, Length
extr_2 = Extrude(Base=boundary_2, Direction=Y_5)
boundary_3 = BoundarySurfaces(Edges=rectangle_4.Rectangle)
boundary_4 = BoundarySurfaces(Edges=move_6.Geometry)
extr_3 = Extrude(Base=boundary_3, Direction=Y_3)
glass = Geometry(boundary_4)
leaves = Geometry(extr_2)
shelves = Geometry(extr_3)
top_board = Geometry(boxrec)
body = Geometry([boxrec_2, extr])

# ==== cluster Cluster
C = ClusterInput()
explode = Explode(Curve=C, Recursive=True)  # -> Segments, Vertices
item = ListItem(List=explode.Vertices, Index=0, Wrap=True)
item_2 = ListItem(List=explode.Vertices, Index=1, Wrap=True)
item_3 = ListItem(List=explode.Vertices, Index=2, Wrap=True)
item_4 = ListItem(List=explode.Vertices, Index=3, Wrap=True)
x = ClusterInput()
pline = PolyLine(Vertices=[item_4, item, item_2, item_3], Closed=False)
neg = Negative(Value=x)
P = Plane(PlaneXY(0, 0, 0))
offset = Offset(Curve=pline, Distance=neg, Plane=P, Corners=1)
pl = ClusterOutput(pline)
end = EndPoints(Curve=pline)  # -> Start, End
C_2 = ClusterOutput(offset)
end_2 = EndPoints(Curve=offset)  # -> Start, End
ln = Line(StartPoint=end.Start, EndPoint=end_2.Start)
ln_2 = Line(StartPoint=end.End, EndPoint=end_2.End)
L = ClusterOutput(ln)
L_2 = ClusterOutput(ln_2)
