# Grasshopper definition Closet.gh (Grasshopper 0.9.76)

# ---- group: Structure
height = Slider(2, range=1.5..4)
leght1 = Slider(3.25, range=1.5..4)
leght2 = Slider(1.8, range=1.5..4)
depth = Slider(0.4, range=0.3..1)
thickness = Slider(0.015, range=0.01..0.05)

# ---- group: Distribution
lenghtcorner = Slider(0.35, range=0..1)
lenghtbalance = Slider(0, range=-0.5..0.5)
baseheight = Slider(0.05, range=0..0.2)
baseoffset = Slider(0.05, range=0..0.2)
shelfheight = Slider(0.28, range=0.1..0.5)
# Medidas "estándar"
# ==================
# Height: 2.00
# Lenght1: 3.25
# Length2:1.80
# Depth:0.40
# Thickness:0.015
# 
# LenghtCorner:0.35%
# LenghtBalance:0.00
# BaseHeight:0.05
# BaseOffset:0.05
# ShelfHeight:0.28
# DrawerHeight:0.15
# DrawerSeparation:0.02
# 
# NumCornerDrawers:5
# Trousers(%):0.00
# NumShelves1:2
# NumDrawers1:3
# NumShelves2:3
# NumDrawers2:5
drawerheight = Slider(0.15, range=0.1..0.25)
drawerseparation = Slider(0.02, range=0..0.05)

# ---- group: Corner Module
numcornerdrawers = Slider(5, range=0..10)

# ---- group: Trousers Module
trousers = Slider(0, range=-0.5..0.5)

# ---- group: Shelves/Drawers 1
numshelves1 = Slider(2, range=1..10)
numdrawers1 = Slider(3, range=1..10)

# ---- group: Shelves/Drawers 2
numshelves2 = Slider(3, range=1..10)
numdrawers2 = Slider(5, range=1..10)

# ----
height_2 = Number(height)
length1 = Number(leght1)
length2 = Number(leght2)
depth_2 = Number(depth)
thickness_2 = Number(thickness)
lengthcorner = Number(lenghtcorner)
lengthbalance = Number(lenghtbalance)
baseheight_2 = Number(baseheight)
baseoffset_2 = Number(baseoffset)
shelfheight_2 = Number(shelfheight)
drawerheight_2 = Number(drawerheight)
drawerseparation_2 = Number(drawerseparation)
numcornerdrawers_2 = Integer(numcornerdrawers)
numshelves1_2 = Integer(numshelves1)
numdrawers1_2 = Integer(numdrawers1)
numshelves2_2 = Integer(numshelves2)
numdrawers2_2 = Integer(numdrawers2)
trousers_2 = Number(trousers)

# ---- group: WideThickness
multiplication = Multiplication(A=thickness_2, B=2.5)

# ---- group: TopHeight
subtraction = Subtraction(A=height_2, B=multiplication)

# ---- group: EfectiveHeight
cluster = Cluster_4(height=height_2, baseheight=baseheight_2, thickness=thickness_2, widethickness=multiplication)

# ---- group: Bases
cluster_2 = Cluster_2(
    length1=length1,
    length2=length2,
    depth=depth_2,
    baseheight=[baseheight_2, subtraction],
    basethickness=[thickness_2, multiplication],
    thickness=thickness_2,
    thickness2=multiplication)  # -> B, crv_2

# ---- group: Extremes
cluster_3 = Cluster_3(height=height_2, depth=depth_2, length1=length1, length2=length2, thickness=multiplication, backcurve=cluster_2.crv_2)  # -> extremes_2, back_2

# ---- group: CornerSeparator
cluster_4 = Cluster_6(
    effectiveheight=cluster,
    length1=length1,
    length2=length2,
    depth=depth_2,
    lengthcorner=lengthcorner,
    baseheight=baseheight_2,
    thickness=thickness_2)  # -> separator_2, cornerpoints_2

# ----
subtraction_2 = Subtraction(A=multiplication, B=thickness_2)
board = Board(
    length1=length1,
    length2=length2,
    depth=depth_2,
    thickness=thickness_2,
    widethickness=multiplication,
    baseheight=baseheight_2,
    baseoffset=baseoffset_2)
y0 = Number(subtraction_2)
c = Point(cluster_4.cornerpoints_2)
item = ListItem(List=c, Index=0, Wrap=True)
item_2 = ListItem(List=c, Index=3, Wrap=True)
pdecon = Deconstruct(Point=item)  # -> XComponent, YComponent, ZComponent

# ---- group: Separator
cluster_5 = Cluster_7(
    effectiveheight=cluster,
    length1=length1,
    depth=depth_2,
    thickness=thickness_2,
    cornerpos=pdecon.YComponent,
    lengthbalance=lengthbalance,
    baseheight=baseheight_2)  # -> separator_2, X_2, y0_2, y1_2

# ----
subtraction_3 = Subtraction(A=cluster_5.y0_2, B=0)
pdecon_2 = Deconstruct(Point=item_2)  # -> XComponent, YComponent, ZComponent
cornermodule = CornerModule(
    cornerpoints=cluster_4.cornerpoints_2,
    height=height_2,
    depth=depth_2,
    thickness=thickness_2,
    shelfheight=shelfheight_2,
    baseheight=baseheight_2,
    drawerheight=drawerheight_2,
    drawerseparation=drawerseparation_2,
    numcornerdrawers=numcornerdrawers_2)  # -> cornershelf_2, drawerstructure_2, drawer_3

# ---- group: Shelves/Drawers 1
shelves_drawers_module = ShelvesDrawersModule(
    height=height_2,
    efectiveheight=cluster,
    depth=depth_2,
    thickness=thickness_2,
    widethickness=multiplication,
    baseheight=baseheight_2,
    shelfheight=shelfheight_2,
    drawerheight=drawerheight_2,
    drawerseparation=drawerseparation_2,
    X=cluster_5.X_2,
    y0=cluster_5.y0_2,
    y1=cluster_5.y1_2,
    numshelves1=numshelves1_2,
    numdrawers1=numdrawers1_2)  # -> shelves_2, drawers_2

# ---- group: Trousers Module
trousersmodule = TrousersModule(
    height=height_2,
    depth=depth_2,
    thickness=thickness_2,
    widethickness=multiplication,
    baseheight=baseheight_2,
    shelfheight=shelfheight_2,
    X=cluster_5.X_2,
    y0=cluster_5.y1_2,
    y1=pdecon.YComponent,
    trousers=trousers_2)  # -> topshelf_2, trousersshelf_2

# ---- group: Shelves/Drawers 2
shelves_drawers_module_2 = ShelvesDrawersModule_2(
    height=height_2,
    efectiveheight=cluster,
    depth=depth_2,
    thickness=thickness_2,
    widethickness=multiplication,
    baseheight=baseheight_2,
    shelfheight=shelfheight_2,
    drawerheight=drawerheight_2,
    drawerseparation=drawerseparation_2,
    X=cluster_5.X_2,
    y0=y0,
    y1=subtraction_3,
    numshelves1=numshelves2_2,
    numdrawers1=numdrawers2_2)  # -> shelves_2, drawers_2

# ---- group: ShelvesModule
cluster_6 = Cluster_8(
    effectiveheight=cluster,
    length2=length2,
    depth=depth_2,
    thickness=thickness_2,
    widethickness=multiplication,
    baseheight=baseheight_2,
    shelfheight=shelfheight_2,
    X=pdecon_2.XComponent,
    Y=pdecon_2.YComponent)

# ----
basetable = Brep(cluster_2.B)
board_2 = Box(board)
separator = Box(cluster_5.separator_2)
cornerdrawerstructure = Box(cornermodule.drawerstructure_2)
trousersshelf = Box(trousersmodule.trousersshelf_2)
drawersmodule2 = Box(shelves_drawers_module_2.drawers_2)
extremes = Box(cluster_3.extremes_2)
back = Brep(cluster_3.back_2)
cornerseparator = Box(cluster_4.separator_2)
cornershelf = Brep(cornermodule.cornershelf_2)
cornerdrawers = Box(cornermodule.drawer_3)
shelves = Box(cluster_6)
shelf = Box(trousersmodule.topshelf_2)
shelvesmodule1 = Box(shelves_drawers_module.shelves_2)
drawersmodule1 = Box(shelves_drawers_module.drawers_2)
shelvesmodule2 = Box(shelves_drawers_module_2.shelves_2)

# ==== cluster Cluster_2
length1 = ClusterInput()
length2 = ClusterInput()
depth = ClusterInput()
baseheight = ClusterInput()
basethickness = ClusterInput()
thickness = ClusterInput()
thickness2 = ClusterInput()
length1_2 = Number(length1)
length2_2 = Number(length2)
depth_2 = Number(depth)
baseheight_2 = Number(baseheight)
basethickness_2 = Number(basethickness)
thickness_2 = Number(thickness)
thickness2_2 = Number(thickness2)
cluster = Cluster(length1=length1_2, length2=length2_2, depth=depth_2, thickness=thickness_2, thickness2=thickness2_2)  # -> basecurve_2, backcurve_2
vec = VectorXYZ(XComponent=0, YComponent=0, ZComponent=baseheight_2)  # -> Vector, Length
vec_2 = VectorXYZ(XComponent=0, YComponent=0, ZComponent=basethickness_2)  # -> Vector, Length
move = Move(Geometry=cluster.basecurve_2, Motion=vec.Vector)  # -> Geometry, Transform
extr = Extrude(Base=move.Geometry, Direction=vec_2.Vector)
cap = CapHoles(Brep=extr)
crv = Curve(cluster.backcurve_2)
B = ClusterOutput(cap)
crv_2 = ClusterOutput(crv)

# ==== cluster Cluster_3
height = ClusterInput()
depth = ClusterInput()
length1 = ClusterInput()
length2 = ClusterInput()
thickness = ClusterInput()
backcurve = ClusterInput()
height_2 = Number(height)
depth_2 = Number(depth)
length1_2 = Number(length1)
length2_2 = Number(length2)
thickness_2 = Number(thickness)
backcurve_2 = Curve(backcurve)
rectangle = Rectangle(Plane=Plane(origin=(0, 0, 0), x=(0, 0, 1), y=(1, 0, 0)), XSize=height_2, YSize=depth_2, Radius=0)  # -> Rectangle, Length
subtraction = Subtraction(A=length1_2, B=depth_2)
subtraction_2 = Subtraction(A=length2_2, B=thickness_2)
vec = VectorXYZ(XComponent=0, YComponent=0, ZComponent=height_2)  # -> Vector, Length
boxrec = BoxRectangle(Rectangle=rectangle.Rectangle, Height=thickness_2)
pt = ConstructPoint(XCoordinate=subtraction_2, YCoordinate=subtraction, ZCoordinate=0)
extr = Extrude(Base=backcurve_2, Direction=vec.Vector)
yz = YZPlane(Origin=pt)
rectangle_2 = Rectangle(Plane=yz, XSize=depth_2, YSize=height_2, Radius=0)  # -> Rectangle, Length
boxrec_2 = BoxRectangle(Rectangle=rectangle_2.Rectangle, Height=thickness_2)
cap = CapHoles(Brep=extr)
extremes = Box([boxrec, boxrec_2])
extremes_2 = ClusterOutput(extremes)
back = Brep(cap)
back_2 = ClusterOutput(back)

# ==== cluster Cluster_4
height = ClusterInput()
baseheight = ClusterInput()
widethickness = ClusterInput()
thickness = ClusterInput()
height_2 = Number(height)
baseheight_2 = Number(baseheight)
widethickness_2 = Number(widethickness)
thickness_2 = Number(thickness)
subtraction = Subtraction(A=height_2, B=baseheight_2)
addition = Addition(A=thickness_2, B=widethickness_2)
subtraction_2 = Subtraction(A=subtraction, B=addition)
effectiveheight = Number(subtraction_2)
effectiveheight_2 = ClusterOutput(effectiveheight)

# ==== cluster Cluster_6
effectiveheight = ClusterInput()
length1 = ClusterInput()
length2 = ClusterInput()
depth = ClusterInput()
lengthcorner = ClusterInput()
baseheight = ClusterInput()
thickness = ClusterInput()
effectiveheight_2 = Number(effectiveheight)
length1_2 = Number(length1)
length2_2 = Number(length2)
depth_2 = Number(depth)
lengthcorner_2 = Number(lengthcorner)
baseheight_2 = Number(baseheight)
thickness_2 = Number(thickness)
min = Minimum(A=length1_2, B=length2_2)
subtraction = Subtraction(A=length1_2, B=depth_2)

# ---- group: CornerPos
cluster = Cluster_5(length=min, depth=depth_2, lengthcorner=lengthcorner_2)

# ----
addition = Addition(A=baseheight_2, B=thickness_2)
subtraction_2 = Subtraction(A=length1_2, B=depth_2)
subtraction_3 = Subtraction(A=length1_2, B=cluster)
addition_2 = Addition(A=subtraction_3, B=thickness_2)
num = Number(cluster)
pt = ConstructPoint(XCoordinate=cluster, YCoordinate=subtraction_2, ZCoordinate=addition)
pt_2 = ConstructPoint(XCoordinate=depth_2, YCoordinate=subtraction_3, ZCoordinate=addition)
neg = Negative(Value=depth_2)
subtraction_4 = Subtraction(A=length1_2, B=thickness_2)
yz = YZPlane(Origin=pt_2)
xz = XZPlane(Origin=pt)
rectangle = Rectangle(Plane=xz, XSize=thickness_2, YSize=effectiveheight_2, Radius=0)  # -> Rectangle, Length
addition_3 = Addition(A=neg, B=thickness_2)
rectangle_2 = Rectangle(Plane=yz, XSize=thickness_2, YSize=effectiveheight_2, Radius=0)  # -> Rectangle, Length
x3 = Number(num)
y1 = Number(addition_2)
y3 = Number(subtraction_4)
x1 = Number(thickness_2)
x2 = Number(depth_2)
y2 = Number(subtraction)
boxrec = BoxRectangle(Rectangle=rectangle.Rectangle, Height=addition_3)
boxrec_2 = BoxRectangle(Rectangle=rectangle_2.Rectangle, Height=addition_3)
pt_3 = ConstructPoint(XCoordinate=x3, YCoordinate=y2, ZCoordinate=0)
pt_4 = ConstructPoint(XCoordinate=x1, YCoordinate=y1, ZCoordinate=0)
pt_5 = ConstructPoint(XCoordinate=x2, YCoordinate=y1, ZCoordinate=0)
pt_6 = ConstructPoint(XCoordinate=x2, YCoordinate=y2, ZCoordinate=0)
pt_7 = ConstructPoint(XCoordinate=x3, YCoordinate=y3, ZCoordinate=0)
pt_8 = ConstructPoint(XCoordinate=x1, YCoordinate=y3, ZCoordinate=0)
separator = Box([boxrec, boxrec_2])
separator_2 = ClusterOutput(separator)
cornerpoints = Point([pt_4, pt_5, pt_6, pt_3, pt_7, pt_8])
cornerpoints_2 = ClusterOutput(cornerpoints)

# ==== cluster Cluster_7
effectiveheight = ClusterInput()
length1 = ClusterInput()
depth = ClusterInput()
thickness = ClusterInput()
cornerpos = ClusterInput()
lengthbalance = ClusterInput()
baseheight = ClusterInput()
effectiveheight_2 = Number(effectiveheight)
length1_2 = Number(length1)
depth_2 = Number(depth)
thickness_2 = Number(thickness)
cornerpos_2 = Number(cornerpos)
lengthbalance_2 = Number(lengthbalance)
baseheight_2 = Number(baseheight)
division = Division(A=cornerpos_2, B=3)
division_2 = Division(A=division, B=2)
multiplication = Multiplication(A=division_2, B=lengthbalance_2)
multiplication_2 = Multiplication(A=division, B=2)
addition = Addition(A=baseheight_2, B=thickness_2)
subtraction = Subtraction(A=division, B=multiplication)
addition_2 = Addition(A=multiplication_2, B=multiplication)
neg = Negative(Value=depth_2)
pt = ConstructPoint(XCoordinate=depth_2, YCoordinate=[subtraction, addition_2], ZCoordinate=addition)
addition_3 = Addition(A=neg, B=thickness_2)
yz = YZPlane(Origin=pt)
rectangle = Rectangle(Plane=yz, XSize=thickness_2, YSize=effectiveheight_2, Radius=0)  # -> Rectangle, Length
boxrec = BoxRectangle(Rectangle=rectangle.Rectangle, Height=addition_3)
separator = Box(boxrec)
y1 = Number(addition_2)
X = Number(depth_2)
y0 = Number(subtraction)
separator_2 = ClusterOutput(separator)
X_2 = ClusterOutput(X)
y0_2 = ClusterOutput(y0)
y1_2 = ClusterOutput(y1)

# ==== cluster CornerModule
cornerpoints = ClusterInput()
height = ClusterInput()
depth = ClusterInput()
thickness = ClusterInput()
shelfheight = ClusterInput()
baseheight = ClusterInput()
drawerheight = ClusterInput()
drawerseparation = ClusterInput()
numcornerdrawers = ClusterInput()
cornerpoints_2 = Point(cornerpoints)
height_2 = Number(height)
depth_2 = Number(depth)
thickness_2 = Number(thickness)
shelfheight_2 = Number(shelfheight)
baseheight_2 = Number(baseheight)
drawerheight_2 = Number(drawerheight)
drawerseparation_2 = Number(drawerseparation)
numcornerdrawers_2 = Integer(numcornerdrawers)
pline = PolyLine(Vertices=cornerpoints_2, Closed=True)
subtraction = Subtraction(A=height_2, B=shelfheight_2)
neg = Negative(Value=thickness_2)
multiplication = Multiplication(A=thickness_2, B=2)
addition = Addition(A=drawerheight_2, B=drawerseparation_2)
vec = VectorXYZ(XComponent=0, YComponent=0, ZComponent=subtraction)  # -> Vector, Length
subtraction_2 = Subtraction(A=subtraction, B=multiplication)
move = Move(Geometry=pline, Motion=vec.Vector)  # -> Geometry, Transform
vec_2 = VectorXYZ(XComponent=0, YComponent=0, ZComponent=neg)  # -> Vector, Length
subtraction_3 = Subtraction(A=subtraction_2, B=baseheight_2)
extr = Extrude(Base=move.Geometry, Direction=vec_2.Vector)
internalheight = Number(subtraction_3)
cap = CapHoles(Brep=extr)
subtraction_4 = Subtraction(A=internalheight, B=thickness_2)
item = ListItem(List=cornerpoints_2, Index=2, Wrap=True)
division = Division(A=subtraction_4, B=addition)
pdecon = Deconstruct(Point=item)  # -> XComponent, YComponent, ZComponent
subtraction_5 = Subtraction(A=division, B=0.5)
addition_2 = Addition(A=baseheight_2, B=thickness_2)
addition_3 = Addition(A=pdecon.XComponent, B=thickness_2)
pt = ConstructPoint(XCoordinate=pdecon.XComponent, YCoordinate=pdecon.YComponent, ZCoordinate=addition_2)
int = Integer(subtraction_5)
xz = XZPlane(Origin=pt)
min = Minimum(A=numcornerdrawers_2, B=int)
neg_2 = Negative(Value=depth_2)
multiplication_2 = Multiplication(A=addition, B=min)
addition_4 = Addition(A=neg_2, B=thickness_2)
addition_5 = Addition(A=multiplication_2, B=thickness_2)
rectangle = Rectangle(Plane=xz, XSize=thickness_2, YSize=addition_5, Radius=0)  # -> Rectangle, Length
addition_6 = Addition(A=addition_5, B=baseheight_2)
pt_2 = ConstructPoint(XCoordinate=pdecon.XComponent, YCoordinate=pdecon.YComponent, ZCoordinate=addition_6)
item_2 = ListItem(List=cornerpoints_2, Index=3, Wrap=True)
series = Series(Start=addition_2, Step=addition, Count=min)
xz_2 = XZPlane(Origin=pt_2)
pdecon_2 = Deconstruct(Point=item_2)  # -> XComponent, YComponent, ZComponent
subtraction_6 = Subtraction(A=pdecon_2.XComponent, B=pdecon.XComponent)
subtraction_7 = Subtraction(A=subtraction_6, B=thickness_2)
boxrec = BoxRectangle(Rectangle=rectangle.Rectangle, Height=addition_4)
rectangle_2 = Rectangle(Plane=xz_2, XSize=subtraction_6, YSize=thickness_2, Radius=0)  # -> Rectangle, Length
drawer = Drawer(X=addition_3, Y=pdecon.YComponent, Z=series, thickness=thickness_2, width=subtraction_7, height=drawerheight_2)
boxrec_2 = BoxRectangle(Rectangle=rectangle_2.Rectangle, Height=addition_4)
cornershelf = Brep(cap)
drawerstructure = Box([boxrec, boxrec_2])
drawer_2 = Box(drawer)
cornershelf_2 = ClusterOutput(cornershelf)
drawerstructure_2 = ClusterOutput(drawerstructure)
drawer_3 = ClusterOutput(drawer_2)

# ==== cluster Cluster_8
effectiveheight = ClusterInput()
length2 = ClusterInput()
depth = ClusterInput()
thickness = ClusterInput()
widethickness = ClusterInput()
baseheight = ClusterInput()
shelfheight = ClusterInput()
X = ClusterInput()
Y = ClusterInput()
effectiveheight_2 = Number(effectiveheight)
length2_2 = Number(length2)
depth_2 = Number(depth)
thickness_2 = Number(thickness)
widethickness_2 = Number(widethickness)
baseheight_2 = Number(baseheight)
shelfheight_2 = Number(shelfheight)
X_2 = Number(X)
Y_2 = Number(Y)
addition = Addition(A=X_2, B=thickness_2)
subtraction = Subtraction(A=depth_2, B=thickness_2)
division = Division(A=effectiveheight_2, B=shelfheight_2)
subtraction_2 = Subtraction(A=length2_2, B=addition)
addition_2 = Addition(A=baseheight_2, B=thickness_2)
subtraction_3 = Subtraction(A=division, B=0.5)
subtraction_4 = Subtraction(A=subtraction_2, B=widethickness_2)
numshelves = Integer(subtraction_3)
subtraction_5 = Subtraction(A=numshelves, B=1)
division_2 = Division(A=effectiveheight_2, B=numshelves)
addition_3 = Addition(A=addition_2, B=division_2)
series = Series(Start=addition_3, Step=division_2, Count=subtraction_5)
shelf = Shelf(X=addition, Y=Y_2, Z=series, thickness=widethickness_2, width=subtraction_4, depth=subtraction)
shelf_2 = ClusterOutput(shelf)

# ==== cluster TrousersModule
height = ClusterInput()
depth = ClusterInput()
widethickness = ClusterInput()
baseheight = ClusterInput()
shelfheight = ClusterInput()
X = ClusterInput()
y1 = ClusterInput()
trousers = ClusterInput()
thickness = ClusterInput()
y0 = ClusterInput()
height_2 = Number(height)
depth_2 = Number(depth)
widethickness_2 = Number(widethickness)
baseheight_2 = Number(baseheight)
shelfheight_2 = Number(shelfheight)
X_2 = Number(X)
y1_2 = Number(y1)
trousers_2 = Number(trousers)
thickness_2 = Number(thickness)
y0_2 = Number(y0)
subtraction = Subtraction(A=height_2, B=shelfheight_2)
addition = Addition(A=y0_2, B=thickness_2)
addition_2 = Addition(A=y0_2, B=y1_2)
addition_3 = Addition(A=baseheight_2, B=thickness_2)
pt = ConstructPoint(XCoordinate=X_2, YCoordinate=addition, ZCoordinate=subtraction)
subtraction_2 = Subtraction(A=y1_2, B=addition)
subtraction_3 = Subtraction(A=subtraction, B=widethickness_2)
division = Division(A=addition_2, B=2)
yz = YZPlane(Origin=pt)
neg = Negative(Value=widethickness_2)
subtraction_4 = Subtraction(A=subtraction_2, B=thickness_2)
addition_4 = Addition(A=subtraction_3, B=addition_3)
neg_2 = Negative(Value=depth_2)
subtraction_5 = Subtraction(A=subtraction_3, B=addition_3)
rectangle = Rectangle(Plane=yz, XSize=subtraction_4, YSize=neg, Radius=0)  # -> Rectangle, Length
addition_5 = Addition(A=neg_2, B=thickness_2)
division_2 = Division(A=addition_4, B=2)
division_3 = Division(A=subtraction_5, B=2)
boxrec = BoxRectangle(Rectangle=rectangle.Rectangle, Height=addition_5)
multiplication = Multiplication(A=division_3, B=trousers_2)
addition_6 = Addition(A=division_2, B=multiplication)
subtraction_6 = Subtraction(A=addition_6, B=addition_3)
pt_2 = ConstructPoint(XCoordinate=X_2, YCoordinate=division, ZCoordinate=addition_6)
pt_3 = ConstructPoint(XCoordinate=X_2, YCoordinate=addition, ZCoordinate=addition_6)
neg_3 = Negative(Value=subtraction_6)
yz_2 = YZPlane(Origin=pt_2)
yz_3 = YZPlane(Origin=pt_3)
rectangle_2 = Rectangle(Plane=yz_2, XSize=thickness_2, YSize=neg_3, Radius=0)  # -> Rectangle, Length
rectangle_3 = Rectangle(Plane=yz_3, XSize=subtraction_4, YSize=thickness_2, Radius=0)  # -> Rectangle, Length
boxrec_2 = BoxRectangle(Rectangle=rectangle_2.Rectangle, Height=addition_5)
boxrec_3 = BoxRectangle(Rectangle=rectangle_3.Rectangle, Height=addition_5)
topshelf = Box(boxrec)
trousersshelf = Box([boxrec_3, boxrec_2])
trousersshelf_2 = ClusterOutput(trousersshelf)
topshelf_2 = ClusterOutput(topshelf)

# ==== cluster ShelvesDrawersModule
X = ClusterInput()
y0 = ClusterInput()
y1 = ClusterInput()
thickness = ClusterInput()
widethickness = ClusterInput()
height = ClusterInput()
depth = ClusterInput()
baseheight = ClusterInput()
shelfheight = ClusterInput()
numshelves1 = ClusterInput()
efectiveheight = ClusterInput()
numdrawers1 = ClusterInput()
drawerheight = ClusterInput()
drawerseparation = ClusterInput()
height_2 = Number(height)
efectiveheight_2 = Number(efectiveheight)
depth_2 = Number(depth)
thickness_2 = Number(thickness)
widethickness_2 = Number(widethickness)
baseheight_2 = Number(baseheight)
shelfheight_2 = Number(shelfheight)
drawerheight_2 = Number(drawerheight)
drawerseparation_2 = Number(drawerseparation)
X_2 = Number(X)
y0_2 = Number(y0)
y1_2 = Number(y1)
numshelves1_2 = Integer(numshelves1)
numdrawers1_2 = Integer(numdrawers1)
subtraction = Subtraction(A=height_2, B=shelfheight_2)
addition = Addition(A=y0_2, B=thickness_2)
neg = Negative(Value=thickness_2)
addition_2 = Addition(A=baseheight_2, B=thickness_2)
neg_2 = Negative(Value=widethickness_2)
neg_3 = Negative(Value=shelfheight_2)
max = Maximum(A=numshelves1_2, B=1)
division = Division(A=efectiveheight_2, B=shelfheight_2)
addition_3 = Addition(A=drawerheight_2, B=drawerseparation_2)
subtraction_2 = Subtraction(A=y1_2, B=y0_2)
subtraction_3 = Subtraction(A=subtraction_2, B=thickness_2)
neg_4 = Negative(Value=depth_2)
subtraction_4 = Subtraction(A=division, B=0.5)
addition_4 = Addition(A=neg_4, B=thickness_2)
int = Integer(subtraction_4)
min = Minimum(A=max, B=int)
series = Series(Start=subtraction, Step=neg_3, Count=min)
subtraction_5 = Subtraction(A=min, B=1)
item = ListItem(List=series, Index=subtraction_5, Wrap=True)

# ---- group: DrawersAvailableHeight
subtraction_6 = Subtraction(A=item, B=addition_2)

# ----
division_2 = Division(A=subtraction_6, B=addition_3)
subtraction_7 = Subtraction(A=division_2, B=0.5)

# ---- group: MaxDrawers
int_2 = Integer(subtraction_7)

# ----
min_2 = Minimum(A=numdrawers1_2, B=int_2)
multiplication = Multiplication(A=min_2, B=addition_3)
series_2 = Series(Start=addition_2, Step=addition_3, Count=min_2)
addition_5 = Addition(A=multiplication, B=addition_2)
addition_6 = Addition(A=widethickness_2, B=addition_5)
num = Number([series, addition_6])
pt = ConstructPoint(XCoordinate=X_2, YCoordinate=addition, ZCoordinate=num)
pt_2 = ConstructPoint(XCoordinate=X_2, YCoordinate=addition, ZCoordinate=series_2)
yz = YZPlane(Origin=pt)
yz_2 = YZPlane(Origin=pt_2)
rectangle = Rectangle(Plane=yz, XSize=subtraction_3, YSize=neg_2, Radius=0)  # -> Rectangle, Length
rectangle_2 = Rectangle(Plane=yz_2, XSize=subtraction_3, YSize=drawerheight_2, Radius=0)  # -> Rectangle, Length
boxrec = BoxRectangle(Rectangle=rectangle.Rectangle, Height=addition_4)
boxrec_2 = BoxRectangle(Rectangle=rectangle_2.Rectangle, Height=neg)
shelves = Box(boxrec)
shelves_2 = ClusterOutput(shelves)
drawers = Box(boxrec_2)
drawers_2 = ClusterOutput(drawers)

# ==== cluster ShelvesDrawersModule_2
height = ClusterInput()
efectiveheight = ClusterInput()
depth = ClusterInput()
thickness = ClusterInput()
widethickness = ClusterInput()
baseheight = ClusterInput()
shelfheight = ClusterInput()
drawerheight = ClusterInput()
drawerseparation = ClusterInput()
X = ClusterInput()
y0 = ClusterInput()
y1 = ClusterInput()
numshelves1 = ClusterInput()
numdrawers1 = ClusterInput()
height_2 = Number(height)
efectiveheight_2 = Number(efectiveheight)
depth_2 = Number(depth)
thickness_2 = Number(thickness)
widethickness_2 = Number(widethickness)
baseheight_2 = Number(baseheight)
shelfheight_2 = Number(shelfheight)
drawerheight_2 = Number(drawerheight)
drawerseparation_2 = Number(drawerseparation)
X_2 = Number(X)
y0_2 = Number(y0)
y1_2 = Number(y1)
numshelves1_2 = Integer(numshelves1)
numdrawers1_2 = Integer(numdrawers1)
subtraction = Subtraction(A=height_2, B=shelfheight_2)
addition = Addition(A=y0_2, B=thickness_2)
neg = Negative(Value=thickness_2)
addition_2 = Addition(A=baseheight_2, B=thickness_2)
neg_2 = Negative(Value=widethickness_2)
neg_3 = Negative(Value=shelfheight_2)
max = Maximum(A=numshelves1_2, B=1)
division = Division(A=efectiveheight_2, B=shelfheight_2)
addition_3 = Addition(A=drawerheight_2, B=drawerseparation_2)
subtraction_2 = Subtraction(A=y1_2, B=y0_2)
subtraction_3 = Subtraction(A=subtraction_2, B=thickness_2)
neg_4 = Negative(Value=depth_2)
subtraction_4 = Subtraction(A=division, B=0.5)
addition_4 = Addition(A=neg_4, B=thickness_2)
int = Integer(subtraction_4)
min = Minimum(A=max, B=int)
series = Series(Start=subtraction, Step=neg_3, Count=min)
subtraction_5 = Subtraction(A=min, B=1)
item = ListItem(List=series, Index=subtraction_5, Wrap=True)

# ---- group: DrawersAvailableHeight
subtraction_6 = Subtraction(A=item, B=addition_2)

# ----
division_2 = Division(A=subtraction_6, B=addition_3)
subtraction_7 = Subtraction(A=division_2, B=0.5)

# ---- group: MaxDrawers
int_2 = Integer(subtraction_7)

# ----
min_2 = Minimum(A=numdrawers1_2, B=int_2)
multiplication = Multiplication(A=min_2, B=addition_3)
series_2 = Series(Start=addition_2, Step=addition_3, Count=min_2)
addition_5 = Addition(A=multiplication, B=addition_2)
addition_6 = Addition(A=widethickness_2, B=addition_5)
num = Number([series, addition_6])
pt = ConstructPoint(XCoordinate=X_2, YCoordinate=addition, ZCoordinate=num)
pt_2 = ConstructPoint(XCoordinate=X_2, YCoordinate=addition, ZCoordinate=series_2)
yz = YZPlane(Origin=pt)
yz_2 = YZPlane(Origin=pt_2)
rectangle = Rectangle(Plane=yz, XSize=subtraction_3, YSize=neg_2, Radius=0)  # -> Rectangle, Length
rectangle_2 = Rectangle(Plane=yz_2, XSize=subtraction_3, YSize=drawerheight_2, Radius=0)  # -> Rectangle, Length
boxrec = BoxRectangle(Rectangle=rectangle.Rectangle, Height=addition_4)
boxrec_2 = BoxRectangle(Rectangle=rectangle_2.Rectangle, Height=neg)
shelves = Box(boxrec)
drawers = Box(boxrec_2)
shelves_2 = ClusterOutput(shelves)
drawers_2 = ClusterOutput(drawers)

# ==== cluster Board
depth = ClusterInput()
thickness = ClusterInput()
length1 = ClusterInput()
length2 = ClusterInput()
baseheight = ClusterInput()
baseoffset = ClusterInput()
widethickness = ClusterInput()
length1_2 = Number(length1)
length2_2 = Number(length2)
depth_2 = Number(depth)
thickness_2 = Number(thickness)
widethickness_2 = Number(widethickness)
baseheight_2 = Number(baseheight)
baseoffset_2 = Number(baseoffset)
subtraction = Subtraction(A=depth_2, B=baseoffset_2)
subtraction_2 = Subtraction(A=length1_2, B=widethickness_2)
subtraction_3 = Subtraction(A=length1_2, B=depth_2)
pt = ConstructPoint(XCoordinate=subtraction, YCoordinate=widethickness_2, ZCoordinate=0)
addition = Addition(A=subtraction_3, B=baseoffset_2)
subtraction_4 = Subtraction(A=length2_2, B=depth_2)
subtraction_5 = Subtraction(A=subtraction_2, B=depth_2)
subtraction_6 = Subtraction(A=subtraction, B=thickness_2)
addition_2 = Addition(A=subtraction_5, B=baseoffset_2)
neg = Negative(Value=thickness_2)
pt_2 = ConstructPoint(XCoordinate=subtraction_6, YCoordinate=addition, ZCoordinate=0)
addition_3 = Addition(A=subtraction_4, B=thickness_2)
yz = YZPlane(Origin=pt)
xz = XZPlane(Origin=pt_2)
rectangle = Rectangle(Plane=yz, XSize=addition_2, YSize=baseheight_2, Radius=0)  # -> Rectangle, Length
rectangle_2 = Rectangle(Plane=xz, XSize=addition_3, YSize=baseheight_2, Radius=0)  # -> Rectangle, Length
boxrec = BoxRectangle(Rectangle=rectangle.Rectangle, Height=neg)
boxrec_2 = BoxRectangle(Rectangle=rectangle_2.Rectangle, Height=neg)
board = Box([boxrec, boxrec_2])
board_2 = ClusterOutput(board)

# ==== cluster Cluster
thickness = ClusterInput()
thickness2 = ClusterInput()
length1 = ClusterInput()
length2 = ClusterInput()
depth = ClusterInput()
length1_2 = Number(length1)
length2_2 = Number(length2)
depth_2 = Number(depth)
thickness_2 = Number(thickness)
thickness2_2 = Number(thickness2)
subtraction = Subtraction(A=length2_2, B=thickness2_2)
subtraction_2 = Subtraction(A=length1_2, B=depth_2)
subtraction_3 = Subtraction(A=length1_2, B=thickness_2)
pt = ConstructPoint(XCoordinate=0, YCoordinate=thickness2_2, ZCoordinate=0)
pt_2 = ConstructPoint(XCoordinate=depth_2, YCoordinate=thickness2_2, ZCoordinate=0)
pt_3 = ConstructPoint(XCoordinate=depth_2, YCoordinate=subtraction_2, ZCoordinate=0)
pt_4 = ConstructPoint(XCoordinate=subtraction, YCoordinate=subtraction_2, ZCoordinate=0)
pt_5 = ConstructPoint(XCoordinate=subtraction, YCoordinate=subtraction_3, ZCoordinate=0)
pt_6 = ConstructPoint(XCoordinate=thickness_2, YCoordinate=subtraction_3, ZCoordinate=0)
pt_7 = ConstructPoint(XCoordinate=thickness_2, YCoordinate=thickness2_2, ZCoordinate=0)
pt_8 = ConstructPoint(XCoordinate=subtraction, YCoordinate=length1_2, ZCoordinate=0)
pt_9 = ConstructPoint(XCoordinate=0, YCoordinate=length1_2, ZCoordinate=0)
pline = PolyLine(Vertices=[pt_7, pt_2, pt_3, pt_4, pt_5, pt_6], Closed=True)
pline_2 = PolyLine(Vertices=[pt, pt_7, pt_6, pt_5, pt_8, pt_9], Closed=True)
basecurve = Curve(pline)
backcurve = Curve(pline_2)
basecurve_2 = ClusterOutput(basecurve)
backcurve_2 = ClusterOutput(backcurve)

# ==== cluster Cluster_5
length = ClusterInput()
depth = ClusterInput()
lengthcorner = ClusterInput()
length_2 = Number(length)
depth_2 = Number(depth)
lengthcorner_2 = Number(lengthcorner)
subtraction = Subtraction(A=length_2, B=depth_2)
multiplication = Multiplication(A=subtraction, B=0.8)
multiplication_2 = Multiplication(A=multiplication, B=lengthcorner_2)
addition = Addition(A=depth_2, B=multiplication_2)
R = ClusterOutput(addition)

# ==== cluster Drawer
X = ClusterInput()
Y = ClusterInput()
Z = ClusterInput()
thickness = ClusterInput()
width = ClusterInput()
height = ClusterInput()
X_2 = Number(X)
Y_2 = Number(Y)
Z_2 = Number(Z)
thickness_2 = Number(thickness)
width_2 = Number(width)
height_2 = Number(height)
pt = ConstructPoint(XCoordinate=X_2, YCoordinate=Y_2, ZCoordinate=Z_2)
xz = XZPlane(Origin=pt)
neg = Negative(Value=thickness_2)
rectangle = Rectangle(Plane=xz, XSize=width_2, YSize=height_2, Radius=0)  # -> Rectangle, Length
boxrec = BoxRectangle(Rectangle=rectangle.Rectangle, Height=neg)
drawer = Box(boxrec)
drawer_2 = ClusterOutput(drawer)

# ==== cluster Shelf
Z = ClusterInput()
X = ClusterInput()
Y = ClusterInput()
thickness = ClusterInput()
width = ClusterInput()
depth = ClusterInput()
Z_2 = Number(Z)
X_2 = Number(X)
Y_2 = Number(Y)
thickness_2 = Number(thickness)
width_2 = Number(width)
depth_2 = Number(depth)
pt = ConstructPoint(XCoordinate=X_2, YCoordinate=Y_2, ZCoordinate=Z_2)
neg = Negative(Value=depth_2)
xz = XZPlane(Origin=pt)
rectangle = Rectangle(Plane=xz, XSize=width_2, YSize=thickness_2, Radius=0)  # -> Rectangle, Length
boxrec = BoxRectangle(Rectangle=rectangle.Rectangle, Height=neg)
shelf = Box(boxrec)
shelf_2 = ClusterOutput(shelf)
