# Grasshopper definition Jalousie Window Simple.gh (Grasshopper 0.9.76)

window_height = Slider(1.91, range=0.01..3)
window_width = Slider(1.25, range=0.01..3)
frame_depth = Slider(0.082, range=0..1)
frame_width = Slider(0.099, range=0..1)
aperture_º = Slider(64, range=0..180)

# ---- group: Rectangular Blade Profile
blade_thickness = Slider(0.026, range=0..1)
blade_width = Slider(0.251, range=0..1)

# ----
xz = XZPlane(Origin=Point(0, 0, 0))
division = Division(A=window_width, B=-2)
division_2 = Division(A=frame_depth, B=2)
rectangle = Rectangle(Plane=xz, XSize=window_width, YSize=window_height, Radius=0)  # -> Rectangle, Length
X = UnitX(Factor=division)
neg = Negative(Value=frame_width)
Y = UnitY(Factor=division_2)
move = Move(Geometry=rectangle.Rectangle, Motion=X)  # -> Geometry, Transform
offset = Offset(Curve=move.Geometry, Distance=neg, Plane=xz, Corners=1)
max = Maximum(A=blade_width, B=blade_thickness)
max_2 = Maximum(A=blade_width, B=blade_thickness)
crv = Curve(flatten([move.Geometry, offset]))
interior_profile = Move(Geometry=offset, Motion=Y)  # -> Geometry, Transform
division_3 = Division(A=max_2, B=-2)
explode = Explode(Curve=interior_profile.Geometry, Recursive=True)  # -> Segments, Vertices
int = Integer(0)
boundary = BoundarySurfaces(Edges=crv)
int_2 = Integer(3)
Y_2 = UnitY(Factor=frame_depth)
Z = UnitZ(Factor=division_3)
vertical_edge = ListItem(List=explode.Segments, Index=int_2, Wrap=True)
divlength = DivideLength(Curve=vertical_edge, Length=max)  # -> Points, Tangents, Parameters
item = ListItem(List=explode.Segments, Index=int, Wrap=True)
extr = Extrude(Base=boundary, Direction=Y_2)
int_3 = Integer(0)
move_2 = Move(Geometry=divlength.Points, Motion=Z)  # -> Geometry, Transform
len = Length(Curve=item)
len_2 = Length(Curve=vertical_edge)
item_2 = ListItem(List=explode.Vertices, Index=int_3, Wrap=True)
yz = YZPlane(Origin=move_2.Geometry)

# ---- group: Rectangular Blades
rectangle_2 = Rectangle(Plane=yz, XSize=blade_width, YSize=blade_thickness, Radius=0)  # -> Rectangle, Length
pcen = PolygonCenter(Polyline=rectangle_2.Rectangle)  # -> CenterV, CenterE, CenterA
vec2pt = Vector2Pt(PointA=pcen.CenterA, PointB=yz, Unitize=False)  # -> Vector, Length
move_3 = Move(Geometry=rectangle_2.Rectangle, Motion=vec2pt.Vector)  # -> Geometry, Transform
X_2 = UnitX(Factor=len)
boundary_2 = BoundarySurfaces(Edges=move_3.Geometry)
rad = Radians(Degrees=aperture_º)
line = LineSDL(Start=move_2.Geometry, Direction=X_2, Length=len)
extr_2 = Extrude(Base=boundary_2, Direction=X_2)
rot3d = Rotate3D(Geometry=extr_2, Angle=rad, Center=move_2.Geometry, Axis=line)  # -> Geometry, Transform
lng = ListLength(List=rot3d.Geometry)
subtraction = Subtraction(A=lng, B=1)
cull_i = CullIndex(List=rot3d.Geometry, Indices=subtraction, Wrap=True)

# ---- group: Fixed lower blade
lng_2 = ListLength(List=cull_i)
division_4 = Division(A=blade_thickness, B=-2)
Y_3 = UnitY(Factor=division_4)
multiplication = Multiplication(A=blade_width, B=lng_2)
move_4 = Move(Geometry=item_2, Motion=Y_3)  # -> Geometry, Transform
yz_2 = YZPlane(Origin=move_4.Geometry)
subtraction_2 = Subtraction(A=len_2, B=multiplication)
rectangle_3 = Rectangle(Plane=yz_2, XSize=blade_thickness, YSize=subtraction_2, Radius=0)  # -> Rectangle, Length
bottom_fixed_blade = Extrude(Base=rectangle_3.Rectangle, Direction=X_2)

# ----
frame = Geometry(extr)

# ---- group: Rectangular Blades
blades = Geometry([cull_i, bottom_fixed_blade])
