# Grasshopper definition Kitchen Cabinet.gh (Grasshopper 0.9.76)

# ---- group: System
totallength = Slider(3.323, range=1..6)
lengthbalance = Slider(0.287, range=0..1)
totalheight = Slider(1.079, range=0.5..1.2)
depth = Slider(0.662, range=0.3..0.8)
separation = Slider(0.03, range=0..0.04)
thickness = Slider(0.037, range=0.01..0.1)

# ---- group: Drawers
lastdrawer = Slider(0.924, range=0..1)
handlewidth = Slider(0.502, range=0.15..0.85)
handleheight = Slider(0.025, range=0.01..0.1)
numdrawers = Slider(3, range=1..5)
handlethickness = Slider(0.02, range=0.01..0.1)

# ---- group: Worktop
worktop_thickness = Slider(0.029, range=0.01..0.1)
worktop_offset = Slider(0.068, range=0..0.2)

# ---- group: Base
baseoffset = Slider(0.074, range=0..0.2)
baseheight = Slider(0.104, range=0..0.4)

# ----
length = Number(totallength)
lengthbalance_2 = Number(lengthbalance)
totalheight_2 = Number(totalheight)
baseheight_2 = Number(baseheight)
depth_2 = Number(depth)
separation_2 = Number(separation)
thickness_2 = Number(thickness)
numdrawers_2 = Integer(numdrawers)
lastdrawer_2 = Number(lastdrawer)
handlewidth_2 = Number(handlewidth)
handleheight_2 = Number(handleheight)
handlethickness_2 = Number(handlethickness)
cluster = Cluster_6(length=length, lengthbalance=lengthbalance_2)  # -> R_2, R, R_3
subtraction = Subtraction(A=totalheight_2, B=baseheight_2)
cabinet2 = Number(cluster.R_3)
drawer = Number(cluster.R_2)
cabinet1 = Number(cluster.R)
addition = Addition(A=drawer, B=cabinet1)

# ---- group: WorkTop
totallength_2 = Number(totallength)
totalheight_3 = Number(totalheight)
depth_3 = Number(depth_2)
worktopthickness = Number(worktop_thickness)
worktopoffset = Number(worktop_offset)
cluster_2 = Cluster_8(
    totallength=totallength_2,
    totalheight=totalheight_3,
    depth=depth_3,
    worktopthickness=worktopthickness,
    worktopoffset=worktopoffset)

# ---- group: Base
totallength_3 = Number(length)
baseheight_3 = Number(baseheight_2)
depth_4 = Number(depth_2)
baseoffset_2 = Number(baseoffset)
cluster_3 = Cluster_7(totallength=totallength_3, baseheight=baseheight_3, depth=depth_4, baseoffset=baseoffset_2)

# ----
cluster_4 = Cluster_2(
    width=drawer,
    height=subtraction,
    depth=depth_2,
    numdrawers=numdrawers_2,
    separation=separation_2,
    lastdrawer=lastdrawer_2,
    thickness=thickness_2,
    handlewidth=handlewidth_2,
    handleheight=handleheight_2,
    handlethickness=handlethickness_2)  # -> drawermodule_2, drawerheight_2
cluster_5 = Cluster_5(
    width=cabinet1,
    height=subtraction,
    depth=depth_2,
    separation=separation_2,
    drawerheight=cluster_4.drawerheight_2,
    thickness=thickness_2,
    handlewidth=handlewidth_2,
    handleheight=handleheight_2,
    handlethickness=handlethickness_2,
    apertureleft=False)
cluster_6 = Cluster_5(
    width=cabinet2,
    height=subtraction,
    depth=depth_2,
    separation=separation_2,
    drawerheight=cluster_4.drawerheight_2,
    thickness=thickness_2,
    handlewidth=handlewidth_2,
    handleheight=handleheight_2,
    handlethickness=handlethickness_2,
    apertureleft=False)
cluster_7 = Cluster_5(
    width=cabinet2,
    height=subtraction,
    depth=depth_2,
    separation=separation_2,
    drawerheight=cluster_4.drawerheight_2,
    thickness=thickness_2,
    handlewidth=handlewidth_2,
    handleheight=handleheight_2,
    handlethickness=handlethickness_2,
    apertureleft=True)
cluster_8 = Cluster_5(
    width=cabinet1,
    height=subtraction,
    depth=depth_2,
    separation=separation_2,
    drawerheight=cluster_4.drawerheight_2,
    thickness=thickness_2,
    handlewidth=handlewidth_2,
    handleheight=handleheight_2,
    handlethickness=handlethickness_2,
    apertureleft=True)
cluster_9 = Cluster_2(
    width=drawer,
    height=subtraction,
    depth=depth_2,
    numdrawers=numdrawers_2,
    separation=separation_2,
    lastdrawer=lastdrawer_2,
    thickness=thickness_2,
    handlewidth=handlewidth_2,
    handleheight=handleheight_2,
    handlethickness=handlethickness_2)  # -> drawermodule_2, drawerheight_2
addition_2 = Addition(A=addition, B=cabinet2)
addition_3 = Addition(A=addition_2, B=cabinet2)
addition_4 = Addition(A=addition_3, B=cabinet1)
vec = VectorXYZ(XComponent=0, YComponent=0, ZComponent=baseheight_2)  # -> Vector, Length
vec_2 = VectorXYZ(XComponent=drawer, YComponent=0, ZComponent=baseheight_2)  # -> Vector, Length
vec_3 = VectorXYZ(XComponent=addition, YComponent=0, ZComponent=baseheight_2)  # -> Vector, Length
vec_4 = VectorXYZ(XComponent=addition_2, YComponent=0, ZComponent=baseheight_2)  # -> Vector, Length
vec_5 = VectorXYZ(XComponent=addition_3, YComponent=0, ZComponent=baseheight_2)  # -> Vector, Length
vec_6 = VectorXYZ(XComponent=addition_4, YComponent=0, ZComponent=baseheight_2)  # -> Vector, Length
move = Move(Geometry=cluster_4.drawermodule_2, Motion=vec.Vector)  # -> Geometry, Transform
move_2 = Move(Geometry=cluster_5, Motion=vec_2.Vector)  # -> Geometry, Transform
move_3 = Move(Geometry=cluster_6, Motion=vec_3.Vector)  # -> Geometry, Transform
move_4 = Move(Geometry=cluster_7, Motion=vec_4.Vector)  # -> Geometry, Transform
move_5 = Move(Geometry=cluster_8, Motion=vec_5.Vector)  # -> Geometry, Transform
move_6 = Move(Geometry=cluster_9.drawermodule_2, Motion=vec_6.Vector)  # -> Geometry, Transform

drawermodule_left = Geometry(move.Geometry)
cabinetmodule_left1 = Geometry(move_2.Geometry)
cabinetmodule_right2 = Geometry(move_4.Geometry)
cabinetmodule_right1 = Geometry(move_5.Geometry)
drawermodule_right = Geometry(move_6.Geometry)
base = Geometry(cluster_3)
worktop = Geometry(cluster_2)
cabinetmodule_left2 = Geometry(move_3.Geometry)

# ==== cluster Cluster_2
width = ClusterInput()
height = ClusterInput()
depth = ClusterInput()
numdrawers = ClusterInput()
separation = ClusterInput()
lastdrawer = ClusterInput()
thickness = ClusterInput()
handlewidth = ClusterInput()
handleheight = ClusterInput()
handlethickness = ClusterInput()
width_2 = Number(width)
height_2 = Number(height)
depth_2 = Number(depth)
numdrawers_2 = Integer(numdrawers)
separation_2 = Number(separation)
lastdrawer_2 = Number(lastdrawer)
thickness_2 = Number(thickness)
handlewidth_2 = Number(handlewidth)
handlethickness_2 = Number(handlethickness)
handleheight_2 = Number(handleheight)
rectangle = Rectangle(Plane=Plane(origin=(0, 0, 0), x=(0, 0, 1), y=(1, 0, 0)), XSize=height_2, YSize=width_2, Radius=0)  # -> Rectangle, Length
addition = Addition(A=numdrawers_2, B=1)
boxrec = BoxRectangle(Rectangle=rectangle.Rectangle, Height=depth_2)
multiplication = Multiplication(A=separation_2, B=2)
multiplication_2 = Multiplication(A=addition, B=separation_2)
subtraction = Subtraction(A=height_2, B=multiplication_2)
addition_2 = Addition(A=numdrawers_2, B=lastdrawer_2)
addition_3 = Addition(A=1, B=lastdrawer_2)
subtraction_2 = Subtraction(A=numdrawers_2, B=1)

# ---- group: DrawerWidth
subtraction_3 = Subtraction(A=width_2, B=multiplication)

# ---- group: DrawerHeight
division = Division(A=subtraction, B=addition_2)

# ----
addition_4 = Addition(A=division, B=separation_2)
series = Series(Start=division, Step=0, Count=subtraction_2)

# ---- group: LastDrawerHeight
multiplication_3 = Multiplication(A=division, B=addition_3)

# ----
addition_5 = Addition(A=multiplication_3, B=multiplication)
cluster = Cluster(
    width=subtraction_3,
    height=graft([series, multiplication_3]),
    thickness=thickness_2,
    handlewidth=handlewidth_2,
    handleheight=handleheight_2,
    handlethickness=handlethickness_2)
series_2 = Series(Start=addition_5, Step=addition_4, Count=subtraction_2)
vec = VectorXYZ(XComponent=separation_2, YComponent=0, ZComponent=series_2)  # -> Vector, Length
vec_2 = VectorXYZ(XComponent=separation_2, YComponent=0, ZComponent=separation_2)  # -> Vector, Length
move = Move(Geometry=cluster, Motion=graft([vec.Vector, vec_2.Vector]))  # -> Geometry, Transform
drawerheight = Number(division)
drawers = Geometry(flatten(move.Geometry))
module = Geometry(boxrec)
drawerheight_2 = ClusterOutput(drawerheight)
drawermodule = Group(Objects=[module, drawers])
drawermodule_2 = ClusterOutput(drawermodule)

# ==== cluster Cluster_5
width = ClusterInput()
height = ClusterInput()
depth = ClusterInput()
separation = ClusterInput()
drawerheight = ClusterInput()
thickness = ClusterInput()
handlewidth = ClusterInput()
handleheight = ClusterInput()
handlethickness = ClusterInput()
apertureleft = ClusterInput()
width_2 = Number(width)
height_2 = Number(height)
depth_2 = Number(depth)
separation_2 = Number(separation)
drawerheight_2 = Number(drawerheight)
thickness_2 = Number(thickness)
handlewidth_2 = Number(handlewidth)
handleheight_2 = Number(handleheight)
handlethickness_2 = Number(handlethickness)
apertureleft_2 = Boolean(apertureleft)
multiplication = Multiplication(A=separation_2, B=2)
addition = Addition(A=drawerheight_2, B=separation_2)
multiplication_2 = Multiplication(A=separation_2, B=3)
subtraction = Subtraction(A=width_2, B=multiplication)
subtraction_2 = Subtraction(A=height_2, B=addition)
subtraction_3 = Subtraction(A=height_2, B=drawerheight_2)
subtraction_4 = Subtraction(A=subtraction_3, B=multiplication_2)

# ---- group: Module
rectangle = Rectangle(Plane=Plane(origin=(0, 0, 0), x=(0, 0, 1), y=(1, 0, 0)), XSize=height_2, YSize=width_2, Radius=0)  # -> Rectangle, Length
boxrec = BoxRectangle(Rectangle=rectangle.Rectangle, Height=depth_2)

# ---- group: Drawer
cluster = Cluster_3(
    width=subtraction,
    height=drawerheight_2,
    thickness=thickness_2,
    handlewidth=handlewidth_2,
    handleheight=handleheight_2,
    handlethickness=handlethickness_2)

# ---- group: Door
cluster_2 = Cluster_4(
    width=subtraction,
    height=subtraction_4,
    thickness=thickness_2,
    separation=separation_2,
    handlesize=handleheight_2,
    handlethickness=handlethickness_2,
    apertureleft=apertureleft_2)

# ----
vec = VectorXYZ(XComponent=separation_2, YComponent=0, ZComponent=subtraction_2)  # -> Vector, Length
vec_2 = VectorXYZ(XComponent=separation_2, YComponent=0, ZComponent=separation_2)  # -> Vector, Length
move = Move(Geometry=cluster, Motion=vec.Vector)  # -> Geometry, Transform
move_2 = Move(Geometry=cluster_2, Motion=vec_2.Vector)  # -> Geometry, Transform
module = Geometry(boxrec)
drawer = Geometry(move.Geometry)
door = Geometry(move_2.Geometry)
cabinetmodule = Group(Objects=[module, drawer, door])
cabinetmodule_2 = ClusterOutput(cabinetmodule)

# ==== cluster Cluster_6
lengthbalance = ClusterInput()
length = ClusterInput()
multiplication = Multiplication(A=lengthbalance, B=0.2)
addition = Addition(A=0.2, B=multiplication)
division = Division(A=length, B=2)
subtraction = Subtraction(A=1, B=addition)
multiplication_2 = Multiplication(A=subtraction, B=0.55)
subtraction_2 = Subtraction(A=subtraction, B=multiplication_2)
drawer = Number(subtraction_2)
cabinet1 = Number(addition)
cabinet2 = Number(multiplication_2)
multiplication_3 = Multiplication(A=division, B=cabinet1)
multiplication_4 = Multiplication(A=division, B=drawer)
multiplication_5 = Multiplication(A=division, B=cabinet2)
R = ClusterOutput(multiplication_3)
R_2 = ClusterOutput(multiplication_4)
R_3 = ClusterOutput(multiplication_5)

# ==== cluster Cluster_7
totallength = ClusterInput()
baseheight = ClusterInput()
baseoffset = ClusterInput()
depth = ClusterInput()
totallength_2 = Number(totallength)
baseheight_2 = Number(baseheight)
depth_2 = Number(depth)
baseoffset_2 = Number(baseoffset)
multiplication = Multiplication(A=baseoffset_2, B=2)
subtraction = Subtraction(A=totallength_2, B=multiplication)
vec = VectorXYZ(XComponent=baseoffset_2, YComponent=baseoffset_2, ZComponent=0)  # -> Vector, Length
subtraction_2 = Subtraction(A=depth_2, B=baseoffset_2)
pl_origin = PlaneOrigin(Base=PlaneXY(0, 0, 0), Origin=vec.Vector)
rectangle = Rectangle(Plane=pl_origin, XSize=subtraction, YSize=subtraction_2, Radius=0)  # -> Rectangle, Length
boxrec = BoxRectangle(Rectangle=rectangle.Rectangle, Height=baseheight_2)
base = Geometry(boxrec)
base_2 = ClusterOutput(base)

# ==== cluster Cluster_8
totallength = ClusterInput()
totalheight = ClusterInput()
depth = ClusterInput()
worktopthickness = ClusterInput()
worktopoffset = ClusterInput()
totallength_2 = Number(totallength)
totalheight_2 = Number(totalheight)
depth_2 = Number(depth)
worktopthickness_2 = Number(worktopthickness)
worktopoffset_2 = Number(worktopoffset)
addition = Addition(A=depth_2, B=worktopoffset_2)
multiplication = Multiplication(A=worktopoffset_2, B=2)
neg = Negative(Value=worktopoffset_2)
addition_2 = Addition(A=totallength_2, B=multiplication)
vec = VectorXYZ(XComponent=neg, YComponent=neg, ZComponent=totalheight_2)  # -> Vector, Length
pl_origin = PlaneOrigin(Base=PlaneXY(0, 0, 0), Origin=vec.Vector)
rectangle = Rectangle(Plane=pl_origin, XSize=addition_2, YSize=addition, Radius=0)  # -> Rectangle, Length
boxrec = BoxRectangle(Rectangle=rectangle.Rectangle, Height=worktopthickness_2)
geo = Geometry(boxrec)
geo_2 = ClusterOutput(geo)

# ==== cluster Cluster
handlewidth = ClusterInput()
handlethickness = ClusterInput()
handleheight = ClusterInput()
thickness = ClusterInput()
width = ClusterInput()
height = ClusterInput()
rectangle = Rectangle(Plane=Plane(origin=(0, 0, 0), x=(0, 0, 1), y=(1, 0, 0)), XSize=height, YSize=width, Radius=0)  # -> Rectangle, Length
multiplication = Multiplication(A=width, B=handlewidth)
num = Number(handlethickness)
rectangle_2 = Rectangle(Plane=Plane(origin=(0, 0, 0), x=(0, 0, 1), y=(1, 0, 0)), XSize=handleheight, YSize=multiplication, Radius=0)  # -> Rectangle, Length
boxrec = BoxRectangle(Rectangle=rectangle.Rectangle, Height=thickness)
subtraction = Subtraction(A=height, B=handleheight)
subtraction_2 = Subtraction(A=width, B=multiplication)
division = Division(A=subtraction, B=2)
division_2 = Division(A=subtraction_2, B=2)
neg = Negative(Value=thickness)
boxrec_2 = BoxRectangle(Rectangle=rectangle_2.Rectangle, Height=num)
vec = VectorXYZ(XComponent=0, YComponent=neg, ZComponent=0)  # -> Vector, Length
subtraction_3 = Subtraction(A=neg, B=num)
vec_2 = VectorXYZ(XComponent=division_2, YComponent=subtraction_3, ZComponent=division)  # -> Vector, Length
move = Move(Geometry=boxrec_2, Motion=vec_2.Vector)  # -> Geometry, Transform
move_2 = Move(Geometry=boxrec, Motion=vec.Vector)  # -> Geometry, Transform
geo = Geometry([move_2.Geometry, move.Geometry])
drawer = ClusterOutput(geo)

# ==== cluster Cluster_3
handlethickness = ClusterInput()
width = ClusterInput()
height = ClusterInput()
thickness = ClusterInput()
handlewidth = ClusterInput()
handleheight = ClusterInput()
rectangle = Rectangle(Plane=Plane(origin=(0, 0, 0), x=(0, 0, 1), y=(1, 0, 0)), XSize=height, YSize=width, Radius=0)  # -> Rectangle, Length
multiplication = Multiplication(A=width, B=handlewidth)
handlethickness_2 = Number(handlethickness)
boxrec = BoxRectangle(Rectangle=rectangle.Rectangle, Height=thickness)
rectangle_2 = Rectangle(Plane=Plane(origin=(0, 0, 0), x=(0, 0, 1), y=(1, 0, 0)), XSize=handleheight, YSize=multiplication, Radius=0)  # -> Rectangle, Length
neg = Negative(Value=thickness)
subtraction = Subtraction(A=width, B=multiplication)
subtraction_2 = Subtraction(A=height, B=handleheight)
division = Division(A=subtraction, B=2)
division_2 = Division(A=subtraction_2, B=2)
boxrec_2 = BoxRectangle(Rectangle=rectangle_2.Rectangle, Height=handlethickness_2)
vec = VectorXYZ(XComponent=0, YComponent=neg, ZComponent=0)  # -> Vector, Length
subtraction_3 = Subtraction(A=neg, B=handlethickness_2)
vec_2 = VectorXYZ(XComponent=division, YComponent=subtraction_3, ZComponent=division_2)  # -> Vector, Length
move = Move(Geometry=boxrec, Motion=vec.Vector)  # -> Geometry, Transform
move_2 = Move(Geometry=boxrec_2, Motion=vec_2.Vector)  # -> Geometry, Transform
geo = Geometry([move.Geometry, move_2.Geometry])
drawer = ClusterOutput(geo)

# ==== cluster Cluster_4
width = ClusterInput()
height = ClusterInput()
thickness = ClusterInput()
separation = ClusterInput()
handlesize = ClusterInput()
handlethickness = ClusterInput()
apertureleft = ClusterInput()
width_2 = Number(width)
height_2 = Number(height)
thickness_2 = Number(thickness)
separation_2 = Number(separation)
handlesize_2 = Number(handlesize)
handlethickness_2 = Number(handlethickness)
apertureleft_2 = Boolean(apertureleft)
addition = Addition(A=separation_2, B=handlesize_2)
subtraction = Subtraction(A=width_2, B=addition)
rectangle = Rectangle(Plane=Plane(origin=(0, 0, 0), x=(0, 0, 1), y=(1, 0, 0)), XSize=height_2, YSize=width_2, Radius=0)  # -> Rectangle, Length
rectangle_2 = Rectangle(Plane=Plane(origin=(0, 0, 0), x=(0, 0, 1), y=(1, 0, 0)), XSize=handlesize_2, YSize=handlesize_2, Radius=0)  # -> Rectangle, Length
c_script = CSharpScript(V1=separation_2, V2=subtraction, C=apertureleft_2)  # -> out, A
# ---------- c_script: C# ----------
    if ((bool)C == true)
      A = V1;
    else
      A = V2;
# ---------- end c_script ----------
subtraction_2 = Subtraction(A=height_2, B=separation_2)
boxrec = BoxRectangle(Rectangle=rectangle.Rectangle, Height=thickness_2)
neg = Negative(Value=thickness_2)
boxrec_2 = BoxRectangle(Rectangle=rectangle_2.Rectangle, Height=handlethickness_2)
subtraction_3 = Subtraction(A=subtraction_2, B=handlesize_2)
subtraction_4 = Subtraction(A=neg, B=handlethickness_2)
vec = VectorXYZ(XComponent=0, YComponent=neg, ZComponent=0)  # -> Vector, Length
move = Move(Geometry=boxrec, Motion=vec.Vector)  # -> Geometry, Transform
vec_2 = VectorXYZ(XComponent=c_script.A, YComponent=subtraction_4, ZComponent=subtraction_3)  # -> Vector, Length
move_2 = Move(Geometry=boxrec_2, Motion=vec_2.Vector)  # -> Geometry, Transform
door = Geometry([move.Geometry, move_2.Geometry])
door_2 = ClusterOutput(door)
