# Grasshopper definition Revolving Door.gh (Grasshopper 0.9.76)

# ---- group: Walls
vertical_frame_width = Slider(0.05, range=0..1)
horizontal_frame_height = Slider(0.14, range=0..1)
door_walls_thickness = Slider(0.061, range=0..1)
number_slider = Slider(4, range=1..10)

# ---- group: Wings
wing_leaf_thickness = Slider(0.095, range=0..0.6)
wing_frame_width = Slider(0.061, range=0..0.6)
number_of_wings = ValueList({"Two": 0, "Three": 1, "Four": 2}, selected="Four")

# ---- group: General
entrance_width = Slider(1.152, range=0.5..2)
overall_height = Slider(2.801, range=2..4)
ceiling_height = Slider(0.211, range=0..1)
overall_width = Slider(3.512, range=1..5)
aperture = Slider(0.6, range=0..1)

# ----
division = Division(A=overall_width, B=2)

# ---- group: 3 WINGS
rad = Radians(Degrees="30")
division_2 = Division(A=wing_leaf_thickness, B=2)
X = UnitX(Factor=wing_leaf_thickness)
tan = Tangent(Value=rad)
division_3 = Division(A=wing_leaf_thickness, B=-2)
yz = YZPlane(Origin=Point(0, 0, 0))
subtraction = Subtraction(A=overall_height, B=ceiling_height)
subtraction_2 = Subtraction(A=division, B=door_walls_thickness)
multiplication = Multiplication(A=tan, B=division_2)
subtraction_3 = Subtraction(A=subtraction_2, B=multiplication)
vec = VectorXYZ(XComponent=division_3, YComponent=multiplication, ZComponent=0)  # -> Vector, Length
rectangle = Rectangle(Plane=yz, XSize=subtraction_3, YSize=subtraction, Radius=0)  # -> Rectangle, Length
move = Move(Geometry=rectangle.Rectangle, Motion=vec.Vector)  # -> Geometry, Transform
offset = Offset(Curve=move.Geometry, Distance=wing_frame_width, Plane=PlaneXY(0, 0, 0), Corners=1)
crv = Curve(flatten([offset, move.Geometry]))
X_2 = UnitX(Factor=division_2)
boundary = BoundarySurfaces(Edges=offset)
boundary_2 = BoundarySurfaces(Edges=crv)
move_2 = Move(Geometry=boundary, Motion=X_2)  # -> Geometry, Transform
extr = Extrude(Base=boundary_2, Direction=X)

# ----
multiplication_2 = Multiplication(A=division, B=2.1)
P = Plane(PlaneXY(0, 0, 0))
Z = UnitZ(Factor=overall_height)
Z_2 = UnitZ(Factor=ceiling_height)
P_2 = Plane(PlaneXY(0, 0, 0))
cir = Circle(Plane=P, Radius=division)
rectangle_2 = Rectangle(Plane=P_2, XSize=entrance_width, YSize=multiplication_2, Radius=0)  # -> Rectangle, Length
move_3 = Move(Geometry=cir, Motion=Z)  # -> Geometry, Transform
neg = Negative(Value=Z_2)
pcen = PolygonCenter(Polyline=rectangle_2.Rectangle)  # -> CenterV, CenterE, CenterA

# ---- group: 4 Wings
division_4 = Division(A=wing_leaf_thickness, B=2)
subtraction_4 = Subtraction(A=subtraction_2, B=division_4)
rectangle_3 = Rectangle(Plane=yz, XSize=subtraction_4, YSize=subtraction, Radius=0)  # -> Rectangle, Length
vec_2 = VectorXYZ(XComponent=division_3, YComponent=division_2, ZComponent=0)  # -> Vector, Length
move_4 = Move(Geometry=rectangle_3.Rectangle, Motion=vec_2.Vector)  # -> Geometry, Transform
offset_2 = Offset(Curve=move_4.Geometry, Distance=wing_frame_width, Plane=PlaneXY(0, 0, 0), Corners=1)
crv_2 = Curve(flatten([move_4.Geometry, offset_2]))
boundary_3 = BoundarySurfaces(Edges=offset_2)
boundary_4 = BoundarySurfaces(Edges=crv_2)
move_5 = Move(Geometry=boundary_3, Motion=X_2)  # -> Geometry, Transform
extr_2 = Extrude(Base=boundary_4, Direction=X)

# ----
vec2pt = Vector2Pt(PointA=pcen.CenterA, PointB=P_2, Unitize=False)  # -> Vector, Length
extr_3 = Extrude(Base=move_3.Geometry, Direction=neg)
neg_2 = Negative(Value=door_walls_thickness)
P_3 = Plane(PlaneXY(0, 0, 0))
move_6 = Move(Geometry=rectangle_2.Rectangle, Motion=vec2pt.Vector)  # -> Geometry, Transform
offset_3 = Offset(Curve=cir, Distance=neg_2, Plane=P_3, Corners=1)

# ---- group: 2 Wings
rectangle_4 = Rectangle(Plane=yz, XSize=subtraction_2, YSize=subtraction, Radius=0)  # -> Rectangle, Length
vec_3 = VectorXYZ(XComponent=division_3, YComponent=0, ZComponent=0)  # -> Vector, Length
move_7 = Move(Geometry=rectangle_4.Rectangle, Motion=vec_3.Vector)  # -> Geometry, Transform
offset_4 = Offset(Curve=move_7.Geometry, Distance=wing_frame_width, Plane=PlaneXY(0, 0, 0), Corners=1)
crv_3 = Curve(flatten([move_7.Geometry, offset_4]))
boundary_5 = BoundarySurfaces(Edges=offset_4)
boundary_6 = BoundarySurfaces(Edges=crv_3)
move_8 = Move(Geometry=boundary_5, Motion=X_2)  # -> Geometry, Transform
extr_4 = Extrude(Base=boundary_6, Direction=X)

# ----
ccx = CurveCurve(CurveA=offset_3, CurveB=move_6.Geometry)  # -> Points, ParamsA, ParamsB
curvepoint = PointOnCurve(offset_3, parameter=0)
item = ListItem(List=ccx.Points, Index="0", Wrap=True)
item_2 = ListItem(List=ccx.Points, Index="3", Wrap=True)
remap = RemapNumbers(Value=aperture, Source=Domain(0, 1), Target="0 to 360")  # -> Mapped, Clipped
arc = Arc3Pt(PointA=item, PointB=curvepoint, PointC=item_2)  # -> Arc, Plane, Radius
Z_3 = UnitZ(Factor=subtraction)
rad_2 = Radians(Degrees=remap.Mapped)

cir_2 = Circle(Plane=item, Radius=vertical_frame_width)
cir_3 = Circle(Plane=item_2, Radius=vertical_frame_width)
move_9 = Move(Geometry=arc.Arc, Motion=Z_3)  # -> Geometry, Transform
curvepoint_2 = PointOnCurve(arc.Arc, parameter=0.504)
ccx_2 = CurveCurve(CurveA=arc.Arc, CurveB=cir_2)  # -> Points, ParamsA, ParamsB
ccx_3 = CurveCurve(CurveA=arc.Arc, CurveB=cir_3)  # -> Points, ParamsA, ParamsB
subtraction_5 = Subtraction(A=subtraction, B=horizontal_frame_height)
Z_4 = UnitZ(Factor=horizontal_frame_height)
Z_5 = UnitZ(Factor=subtraction_5)
arc_2 = Arc3Pt(PointA=ccx_2.Points, PointB=curvepoint_2, PointC=ccx_3.Points)  # -> Arc, Plane, Radius
multiplication_3 = Multiplication(A=door_walls_thickness, B=2)
move_10 = Move(Geometry=arc_2.Arc, Motion=Z_4)  # -> Geometry, Transform
move_11 = Move(Geometry=arc_2.Arc, Motion=Z_5)  # -> Geometry, Transform
neg_3 = Negative(Value=multiplication_3)
loft = Loft(
    Curves=[move_9.Geometry, arc.Arc],
    Options={Adjust=False, Closed=False, LoftEnds=0, LoftSimp=0, LoftType=0, Rebuild=10, Refit=0.01})
neg_4 = Negative(Value=door_walls_thickness)
loft_2 = Loft(
    Curves=[move_10.Geometry, move_11.Geometry],
    Options={Adjust=False, Closed=False, LoftEnds=0, LoftSimp=0, LoftType=0, Rebuild=10, Refit=0.01})
offset_5 = Offset(Surface=loft_2, Distance=multiplication_3, Retrim=True)
offset_6 = Offset(Surface=loft_2, Distance=neg_3, Retrim=True)
offset_7 = Offset(Surface=loft, Distance=neg_4, Retrim=True)
loft_3 = Loft(
    Curves=[offset_5, offset_6],
    Options={Adjust=False, Closed=False, LoftEnds=0, LoftSimp=0, LoftType=0, Rebuild=10, Refit=0.01})
loft_4 = Loft(
    Curves=[offset_7, loft],
    Options={Adjust=False, Closed=False, LoftEnds=0, LoftSimp=0, LoftType=0, Rebuild=10, Refit=0.01})
join = BrepJoin(Breps=[offset_6, offset_5, loft_3])  # -> Breps, Closed
join_2 = BrepJoin(Breps=[loft_4, offset_7, loft])  # -> Breps, Closed
division_5 = Division(A=door_walls_thickness, B=2)

# ---- group: 3 Wings
rad_3 = Radians(Degrees="120")
rad_4 = Radians(Degrees="240")
rad_5 = Radians(Degrees="120")
rad_6 = Radians(Degrees="240")
rot3d = Rotate3D(Geometry=move_2.Geometry, Angle=[rad_3, rad_4], Center=Point(0, 0, 0), Axis=Vector(0, 0, 1))  # -> Geometry, Transform
rot3d_2 = Rotate3D(Geometry=extr, Angle=[rad_5, rad_6], Center=Point(0, 0, 0), Axis=Vector(0, 0, 1))  # -> Geometry, Transform

# ---- group: 2 Wings
rad_7 = Radians(Degrees="180")
rad_8 = Radians(Degrees="180")
rot3d_3 = Rotate3D(Geometry=move_8.Geometry, Angle=rad_7, Center=Point(0, 0, 0), Axis=Vector(0, 0, 1))  # -> Geometry, Transform
rot3d_4 = Rotate3D(Geometry=extr_4, Angle=rad_8, Center=Point(0, 0, 0), Axis=Vector(0, 0, 1))  # -> Geometry, Transform

# ---- group: 4 Wings
rad_9 = Radians(Degrees="90")
rad_10 = Radians(Degrees="180")
rad_11 = Radians(Degrees="270")
rad_12 = Radians(Degrees="90")
rad_13 = Radians(Degrees="180")
rad_14 = Radians(Degrees="270")
rot3d_5 = Rotate3D(Geometry=move_5.Geometry, Angle=[rad_9, rad_10, rad_11], Center=Point(0, 0, 0), Axis=Vector(0, 0, 1))  # -> Geometry, Transform
rot3d_6 = Rotate3D(Geometry=extr_2, Angle=[rad_12, rad_13, rad_14], Center=Point(0, 0, 0), Axis=Vector(0, 0, 1))  # -> Geometry, Transform

# ----
division_6 = Division(A=vertical_frame_width, B=2)
multiplication_4 = Multiplication(A=horizontal_frame_height, B=2)
subtraction_6 = Subtraction(A=subtraction, B=multiplication_4)
end = EndPoints(Curve=arc.Arc)  # -> Start, End
divide = DivideCurve(Curve=arc.Arc, Count=number_slider, Kinks=False)  # -> Points, Tangents, Parameters
Z_6 = UnitZ(Factor=subtraction_6)
cir_4 = Circle(Plane=end.Start, Radius=vertical_frame_width)
cir_5 = Circle(Plane=end.End, Radius=vertical_frame_width)
cir_6 = Circle(Plane=divide.Points, Radius=division_6)
division_7 = Division(A=door_walls_thickness, B=2)
ccx_4 = CurveCurve(CurveA=arc.Arc, CurveB=cir_4)  # -> Points, ParamsA, ParamsB
ccx_5 = CurveCurve(CurveA=arc.Arc, CurveB=cir_5)  # -> Points, ParamsA, ParamsB
ccx_6 = CurveCurve(CurveA=arc.Arc, CurveB=cir_6)  # -> flatten(Points), ParamsA, ParamsB
lng = ListLength(List=ccx_6.Points)
subtraction_7 = Subtraction(A=lng, B=1)
cull_i = CullIndex(List=ccx_6.Points, Indices=["0", subtraction_7], Wrap=True)
ins = InsertItems(List=cull_i, Item=[ccx_4.Points, ccx_5.Points], Indices=0, Wrap=True)
crv_cp = CurveClosestPoint(Point=ins, Curve=arc.Arc)  # -> Point, Parameter, Distance
shatter = Shatter(Curve=arc.Arc, Parameters=crv_cp.Parameter)
cull = CullPattern(List=shatter, CullPattern=[False, True])
move_12 = Move(Geometry=cull, Motion=Z_4)  # -> Geometry, Transform
glass = Extrude(Base=move_12.Geometry, Direction=Z_6)
offset_8 = Offset(Surface=glass, Distance=multiplication_3, Retrim=True)  # -> graft(Surface)
offset_9 = Offset(Surface=glass, Distance=neg_3, Retrim=True)  # -> graft(Surface)
loft_5 = Loft(
    Curves=[offset_8, offset_9],
    Options={Adjust=False, Closed=False, LoftEnds=0, LoftSimp=0, LoftType=0, Rebuild=10, Refit=0.01})
join_3 = BrepJoin(Breps=[offset_8, offset_9, loft_5])  # -> flatten(Breps), Closed

rot3d_7 = Rotate3D(Geometry=[move_8.Geometry, rot3d_3.Geometry], Angle=rad_2, Center=Point(0, 0, 0), Axis=Vector(0, 0, 1))  # -> Geometry, Transform
rot3d_8 = Rotate3D(Geometry=[extr_4, rot3d_4.Geometry], Angle=rad_2, Center=Point(0, 0, 0), Axis=Vector(0, 0, 1))  # -> Geometry, Transform
rot3d_9 = Rotate3D(Geometry=[move_2.Geometry, rot3d.Geometry], Angle=rad_2, Center=Point(0, 0, 0), Axis=Vector(0, 0, 1))  # -> Geometry, Transform
rot3d_10 = Rotate3D(Geometry=[extr, rot3d_2.Geometry], Angle=rad_2, Center=Point(0, 0, 0), Axis=Vector(0, 0, 1))  # -> Geometry, Transform
rot3d_11 = Rotate3D(Geometry=[move_5.Geometry, rot3d_5.Geometry], Angle=rad_2, Center=Point(0, 0, 0), Axis=Vector(0, 0, 1))  # -> Geometry, Transform
rot3d_12 = Rotate3D(Geometry=[extr_2, rot3d_6.Geometry], Angle=rad_2, Center=Point(0, 0, 0), Axis=Vector(0, 0, 1))  # -> Geometry, Transform
P_4 = Plane(PlaneYZ(0, 0, 0))
P_5 = Plane(PlaneYZ(0, 0, 0))
group = Group(Objects=rot3d_7.Geometry)
group_2 = Group(Objects=rot3d_8.Geometry)
group_3 = Group(Objects=rot3d_9.Geometry)
group_4 = Group(Objects=rot3d_10.Geometry)
group_5 = Group(Objects=rot3d_11.Geometry)
group_6 = Group(Objects=rot3d_12.Geometry)

# ---- group: Walls Frame
sdiff = SolidDifference(BrepsA=join_2.Breps, BrepsB=join.Breps)
mirror = Mirror(Geometry=sdiff, Plane=P_4)  # -> Geometry, Transform

# ---- group: Walls Glass
offset_10 = Offset(Surface=loft_2, Distance=division_5, Retrim=True)
mirror_2 = Mirror(Geometry=offset_10, Plane=P_5)  # -> Geometry, Transform

# ----
item_3 = ListItem(List=[group, group_3, group_5], Index=number_of_wings, Wrap=True)
item_4 = ListItem(List=[group_2, group_4, group_6], Index=number_of_wings, Wrap=True)

sdiff_2 = SolidDifference(BrepsA=join_2.Breps, BrepsB=join_3.Breps)
mirror_3 = Mirror(Geometry=sdiff_2, Plane=P_4)  # -> Geometry, Transform

offset_11 = Offset(Surface=glass, Distance=division_7, Retrim=True)
mirror_4 = Mirror(Geometry=offset_11, Plane=P_5)  # -> Geometry, Transform

cylinder = Cylinder(Base=PlaneXY(0, 0, 0), Radius=division, Length=overall_height)
cap = CapHoles(Brep=extr_3)
wings_glass = Geometry(item_3)
wings_frame = Geometry(item_4)
frames = Geometry([mirror_3.Geometry, sdiff_2])
glass_2 = Geometry([mirror_4.Geometry, offset_11])
ceiling = Geometry(cap)
