# Grasshopper definition Shelf.gh (Grasshopper 0.9.76)

# ---- group: Shelf
width = Slider(1.156, range=0.2..3)
thickness = Slider(0.039, range=0.001..0.1)
depth = Slider(0.478, range=0.2..1.5)

# ---- group: System
padding = Slider(0.442, range=0..1)
height = Slider(2.03, range=0.5..4)
numshelves = Slider(5, range=1..10)

# ----
shelf = Shelf(width=width, depth=depth, thickness=thickness, padding=padding)
shelves_position = ShelvesPosition(width=width, height=height, numshelves=numshelves, padding=padding)

# ---- group: Background
cluster = Cluster(width=width, depth=depth, thickness=thickness, height=height)

# ----
move = Move(Geometry=shelf, Motion=shelves_position)  # -> Geometry, Transform
shelves = Geometry(move.Geometry)
background = Geometry(cluster)

# ==== cluster Shelf
width = ClusterInput()
thickness = ClusterInput()
padding = ClusterInput()
depth = ClusterInput()
division = Division(A=width, B=2)
xy = XYPlane(Origin=Point(0, 0, 0))
division_2 = Division(A=thickness, B=2)
multiplication = Multiplication(A=division, B=padding)
subtraction = Subtraction(A=width, B=multiplication)
neg = Negative(Value=division_2)
rectangle = Rectangle(Plane=xy, XSize=subtraction, YSize=depth, Radius=0)  # -> Rectangle, Length
dom = ConstructDomain(DomainStart=neg, DomainEnd=division_2)
boxrec = BoxRectangle(Rectangle=rectangle.Rectangle, Height=dom)
B = ClusterOutput(boxrec)

# ==== cluster ShelvesPosition
numshelves = ClusterInput()
padding = ClusterInput()
height = ClusterInput()
width = ClusterInput()
addition = Addition(A=numshelves, B=1)
division = Division(A=width, B=2)
division_2 = Division(A=height, B=addition)
multiplication = Multiplication(A=division, B=padding)
series = Series(Start=division_2, Step=division_2, Count=numshelves)
subtraction = Subtraction(A=width, B=multiplication)
subtraction_2 = Subtraction(A=width, B=subtraction)
division_3 = Division(A=subtraction_2, B=2)
vec = VectorXYZ(XComponent=division_3, YComponent=0, ZComponent=series)  # -> Vector, Length
V = ClusterOutput(vec.Vector)

# ==== cluster Cluster
width = ClusterInput()
depth = ClusterInput()
thickness = ClusterInput()
height = ClusterInput()
rectangle = Rectangle(Plane=Plane(origin=(0, 0, 0), x=(0, 0, 1), y=(1, 0, 0)), XSize=height, YSize=width, Radius=0)  # -> Rectangle, Length
boxrec = BoxRectangle(Rectangle=rectangle.Rectangle, Height=thickness)
vec = VectorXYZ(XComponent=0, YComponent=depth, ZComponent=0)  # -> Vector, Length
move = Move(Geometry=boxrec, Motion=vec.Vector)  # -> Geometry, Transform
G = ClusterOutput(move.Geometry)
