# Grasshopper definition ShelvingSystem.gh (Grasshopper 0.9.76)

# ---- group: System
width = Slider(4.565, range=1..5)
numshelves = Slider(5, range=1..10)
even_offset = Slider(0.275, range=0..1)
height = Slider(2.5, range=0.5..4)
nummodules = Slider(4, range=1..10)

# ---- group: Skeleton
profilewidth = Slider(0.05, range=0.02..0.3)
extreme_offset = Slider(0.25, range=0..1)

# ---- group: Shelf
thickness = Slider(0.03, range=0.001..0.1)
depth = Slider(0.5, range=0.2..1.5)

# ---- group: Shelf Width
cluster = Cluster_5(A=width, B=nummodules)

# ----
shelf = Shelf(X=cluster, Y=depth, H=thickness)
shelves_position = ShelvesPosition(width=cluster, thickness=thickness, height=height, numshelves=numshelves, nummodules=nummodules, evenoffset=even_offset)
column = Column(profilewidth=profilewidth, height=height)

# ---- group: Colums Position
cluster_2 = Cluster(width=cluster, depth=depth, nummodules=nummodules)  # -> V, xpos

# ---- group: Extremes Position
cluster_3 = Cluster_2(width=cluster, depth=depth, nummodules=nummodules, extremeoffset=extreme_offset)  # -> V, num_2

# ----
member = Member(A_2=profilewidth, A=depth)

# ---- group: Reinforcement
cluster_4 = Cluster_4(depth=depth, width=cluster, height=height, nummodules=nummodules, profilewidth=profilewidth)

# ----
move = Move(Geometry=shelf, Motion=shelves_position)  # -> Geometry, Transform
move_2 = Move(Geometry=column, Motion=[cluster_2.V, cluster_3.V])  # -> Geometry, Transform

# ---- group: Members Position
cluster_5 = Cluster_3(xpos=[cluster_2.xpos, cluster_3.num_2], profilewidth=profilewidth, height=height)

# ----
move_3 = Move(Geometry=member, Motion=cluster_5)  # -> Geometry, Transform

# ---- group: ShelvingSystem
reinforcement = Geometry(cluster_4)
shelves = Geometry(move.Geometry)
columns = Geometry(move_2.Geometry)
members = Geometry(move_3.Geometry)

# ==== cluster Shelf
H = ClusterInput()
xy = XYPlane(Origin=Point(0, 0, 0))
X = ClusterInput()
Y = ClusterInput()
division = Division(A=H, B=2)
neg = Negative(Value=division)
rectangle = Rectangle(Plane=xy, XSize=X, YSize=Y, Radius=0)  # -> Rectangle, Length
dom = ConstructDomain(DomainStart=neg, DomainEnd=division)
boxrec = BoxRectangle(Rectangle=rectangle.Rectangle, Height=dom)
B = ClusterOutput(boxrec)

# ==== cluster Column
profilewidth = ClusterInput()
height = ClusterInput()
division = Division(A=profilewidth, B=2)
neg = Negative(Value=division)
dom = ConstructDomain(DomainStart=neg, DomainEnd=division)
rectangle = Rectangle(Plane=PlaneXY(0, 0, 0), XSize=dom, YSize=dom, Radius=0)  # -> Rectangle, Length
boxrec = BoxRectangle(Rectangle=rectangle.Rectangle, Height=height)
B = ClusterOutput(boxrec)

# ==== cluster Member
A = ClusterInput()
A_2 = ClusterInput()
division = Division(A=A_2, B=2)
neg = Negative(Value=division)
dom = ConstructDomain(DomainStart=neg, DomainEnd=division)
addition = Addition(A=A, B=A_2)
rectangle = Rectangle(Plane=Plane(origin=(0, 0, 0), x=(0, 0, 1), y=(1, 0, 0)), XSize=dom, YSize=dom, Radius=0)  # -> Rectangle, Length
boxrec = BoxRectangle(Rectangle=rectangle.Rectangle, Height=addition)
B = ClusterOutput(boxrec)

# ==== cluster ShelvesPosition
width = ClusterInput()
thickness = ClusterInput()
height = ClusterInput()
numshelves = ClusterInput()
nummodules = ClusterInput()
evenoffset = ClusterInput()
addition = Addition(A=numshelves, B=1)
division = Division(A=thickness, B=2)
division_2 = Division(A=height, B=addition)
series = Series(Start=0, Step=1, Count=nummodules)
series_2 = Series(Start=0, Step=width, Count=nummodules)
series_3 = Series(Start=division_2, Step=division_2, Count=numshelves)
subtraction = Subtraction(A=division_2, B=division)
mod = Modulus(A=series, B=2)
multiplication = Multiplication(A=subtraction, B=evenoffset)
multiplication_2 = Multiplication(A=multiplication, B=mod)
neg = Negative(Value=multiplication_2)
vec = VectorXYZ(XComponent=graft(series_2), YComponent=0, ZComponent=series_3)  # -> Vector, Length
vec_2 = VectorXYZ(XComponent=0, YComponent=0, ZComponent=neg)  # -> Vector, Length
addition_2 = Addition(A=vec.Vector, B=graft(vec_2.Vector))
R = ClusterOutput(addition_2)

# ==== cluster Cluster
width = ClusterInput()
depth = ClusterInput()
nummodules = ClusterInput()
subtraction = Subtraction(A=nummodules, B=1)
subtraction_2 = Subtraction(A=depth, B=depth)
series = Series(Start=width, Step=width, Count=subtraction)
vec = VectorXYZ(XComponent=graft(series), YComponent=[subtraction_2, depth], ZComponent=0)  # -> Vector, Length
V = ClusterOutput(vec.Vector)
xpos = ClusterOutput(series)

# ==== cluster Cluster_2
extremeoffset = ClusterInput()
width = ClusterInput()
depth = ClusterInput()
nummodules = ClusterInput()
subtraction = Subtraction(A=depth, B=depth)
multiplication = Multiplication(A=width, B=nummodules)
division = Division(A=width, B=2)
multiplication_2 = Multiplication(A=division, B=extremeoffset)
subtraction_2 = Subtraction(A=multiplication, B=multiplication_2)
num = Number([multiplication_2, subtraction_2])
vec = VectorXYZ(XComponent=graft(num), YComponent=[subtraction, depth], ZComponent=0)  # -> Vector, Length
V = ClusterOutput(vec.Vector)
num_2 = ClusterOutput(num)

# ==== cluster Cluster_3
profilewidth = ClusterInput()
height = ClusterInput()
xpos = ClusterInput()
division = Division(A=profilewidth, B=2)
num = Number(xpos)
addition = Addition(A=height, B=division)
neg = Negative(Value=division)
vec = VectorXYZ(XComponent=flatten(num), YComponent=neg, ZComponent=addition)  # -> Vector, Length
V = ClusterOutput(vec.Vector)

# ==== cluster Cluster_4
depth = ClusterInput()
width = ClusterInput()
height = ClusterInput()
nummodules = ClusterInput()
profilewidth = ClusterInput()
multiplication = Multiplication(A=width, B=nummodules)
addition = Addition(A=height, B=profilewidth)
multiplication_2 = Multiplication(A=profilewidth, B=2)
division = Division(A=profilewidth, B=2)
addition_2 = Addition(A=addition, B=division)
addition_3 = Addition(A=multiplication_2, B=multiplication)
neg = Negative(Value=division)
dom = ConstructDomain(DomainStart=neg, DomainEnd=division)
column = Column(profilewidth=profilewidth, height=addition)
rectangle = Rectangle(Plane=PlaneYZ(0, 0, 0), XSize=dom, YSize=dom, Radius=0)  # -> Rectangle, Length
neg_2 = Negative(Value=division)
addition_4 = Addition(A=multiplication, B=division)
division_2 = Division(A=depth, B=2)
neg_3 = Negative(Value=profilewidth)
vec = VectorXYZ(XComponent=[addition_4, neg_2], YComponent=division_2, ZComponent=0)  # -> Vector, Length
vec_2 = VectorXYZ(XComponent=neg_3, YComponent=division_2, ZComponent=addition_2)  # -> Vector, Length
boxrec = BoxRectangle(Rectangle=rectangle.Rectangle, Height=addition_3)
move = Move(Geometry=column, Motion=vec.Vector)  # -> Geometry, Transform
move_2 = Move(Geometry=boxrec, Motion=vec_2.Vector)  # -> Geometry, Transform
geo = Geometry([move.Geometry, move_2.Geometry])
geo_2 = ClusterOutput(geo)

# ==== cluster Cluster_5
A = ClusterInput()
B = ClusterInput()
division = Division(A=A, B=B)
num = Number(division)
num_2 = ClusterOutput(num)
